# Grasshopper definition 03. VK_DaylightMetrics_script.gh (Grasshopper 1.0.7)
# Copyright: Tegnestuen Vandkunsten
# plug-ins: Human, Ironbug, MetaHopper, Bifocals, Ironbug.LBHB_Legacy, LunchBox, EleFront

brep = Brep([<brep referenced from the Rhino model> x59])

# ----
# Project
name_of_project = Panel("Indsæt Projektnavn")
# INPUT
image = ImageSampler(Filter="Colour", Interpolate=False, Umax=1, Umin=0, Vmax=1, Vmin=0, Wrap=0)
docinfo = GhPythonScript()  # -> out, version, fileName, filePath, dateCreated, author, dateUpdated, description
# ---------- docinfo: Python ----------
__author__ = "ibc"
__version__ = "2020.10.07"

import rhinoscriptsyntax as rs
import Grasshopper as gh
import Grasshopper.CentralSettings as settings
import time

version = gh.Versioning.Version
fileName = ghdoc.Name
filePath = ghdoc.Path
dateCreated = ghenv.Component.OnPingDocument().Properties.Date
author = settings.AuthorName
dateUpdated = time.strftime("%m/%d/%Y %H:%M:%S")
description = ghenv.Component.OnPingDocument().Properties.Description
# ---------- end docinfo ----------
docinfo_2 = DocumentInfo(AutoUpdate=False, Recursive=False)  # -> DocumentName, DocumentFilePath, Components, Params, _3rdPartyAssemblies
panel = Panel([docinfo.version, docinfo.fileName, docinfo.filePath, docinfo.dateCreated, docinfo.author, docinfo.dateUpdated, docinfo.description, docinfo_2._3rdPartyAssemblies])

# ---- group: Windows
simlay = CreatesSimLayers(bool=Toggle(False))
simple_largest_brep = SimpleLargestBrep(i=0, breps=brep)
simple_sort = SimpleSort()  # -> ceiling_2, floor_2, walls_2

# ----
panel_2 = Panel(docinfo.fileName)

# ---- group: Customize Canvas
customize_canvas = CSharpScript(
    switcher=Toggle(True),
    canvas_back=ColourSwatch(SwatchColor=RGB(221, 235, 211)),
    canvas_grid=ColourSwatch(SwatchColor=RGB(255, 255, 255)))  # -> out, A; inputs switcher: Boolean, canvas_back: Color, canvas_grid: Color
# ---------- customize_canvas: C# usings ----------
using System.IO;
using System.Linq;
using System.Data;
using System.Drawing;
using System.Reflection;
using System.Windows.Forms;
using System.Xml;
using System.Xml.Linq;
using System.Runtime.InteropServices;

using Rhino.DocObjects;
using Rhino.Collections;
using GH_IO;
using GH_IO.Serialization;
# ---------- customize_canvas: C# ----------
    //Code found on http://james-ramsden.com/change-the-colour-of-the-grasshopper-canvas/ and was developed by Johannes Braumann
    //Thank you to the makers of this code and for making it open-source
    
    if (switcher == true)
    {
      Grasshopper.GUI.Canvas.GH_Skin.canvas_grid = canvas_grid;
      Grasshopper.GUI.Canvas.GH_Skin.canvas_back = canvas_back;
      Grasshopper.GUI.Canvas.GH_Skin.canvas_edge = Color.FromArgb(255, 0, 0, 0);
      Grasshopper.GUI.Canvas.GH_Skin.canvas_shade = Color.FromArgb(80, 0, 0, 0);
    }
    else
    {
      //DEFAULTS
      Grasshopper.GUI.Canvas.GH_Skin.canvas_grid = Color.FromArgb(30, 0, 0, 0);
      Grasshopper.GUI.Canvas.GH_Skin.canvas_back = Color.FromArgb(255, 212, 208, 200);
      Grasshopper.GUI.Canvas.GH_Skin.canvas_edge = Color.FromArgb(255, 0, 0, 0);
      Grasshopper.GUI.Canvas.GH_Skin.canvas_shade = Color.FromArgb(80, 0, 0, 0);
    }
# ---------- end customize_canvas ----------

# ----
brep_2 = Brep(simple_largest_brep)

# ----
# Apertures/Glazing
reflectane_transparency = ValueList({"0", "1", "2", "3", "4", "5", "6", "7", "8", "9"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}, selected="72")
reflectane_transparency_2 = ValueList({"0", "1", "2", "3", "4", "5", "6", "7", "8", "9"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}, selected="88")
panel_3 = Panel("glas")
cluster = Cluster_2(B=panel_3, C=reflectane_transparency)  # -> T, txt_4, txt_5
glassmod = HBGlassModifier(name=cluster.txt_4, trans=cluster.txt_5)  # -> modifier; plug-in component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
aperture = HBAperture(geo=cluster.T, name=cluster.txt_4, rad_mod=glassmod)  # -> report, apertures; plug-in component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
clean = CleanTree(RemoveNulls=True, RemoveInvalid=True, RemoveEmpty=True, Tree=aperture.apertures)

# ----
# Daylight-model
toggle = FalseStartToggle(False)
toggle_2 = FalseStartToggle(True)
wiredisplay = ControlWireDisplay(
    WireDisplay=Slider(2, range=0..2),
    AllObjects_Object=[model, assigngridsviews, panel_14, reflectane_transparency_7, panel_9, reflectane_transparency_9, panel_8, opaquemod_6, shade, reflectane_transparency_8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])
hideshow = HideShowObjectPreview(
    Visible=toggle,
    AllObjects_Object=[model, assigngridsviews, panel_14, reflectane_transparency_7, panel_9, reflectane_transparency_9, panel_8, opaquemod_6, shade, reflectane_transparency_8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])
onoff = EnableDisableObject(
    Enabled=toggle_2,
    AllObjects_Object=[model, assigngridsviews, panel_14, reflectane_transparency_7, panel_9, reflectane_transparency_9, panel_8, opaquemod_6, shade, reflectane_transparency_8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])

# ----
# Opaque Materials
reflectane_transparency_3 = ValueList({"0", "1", "2", "3", "4", "5", "6", "7", "8", "9"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}, selected="50")
reflectane_transparency_4 = ValueList({"0", "1", "2", "3", "4", "5", "6", "7", "8", "9"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}, selected="70")
panel_4 = Panel("wall")
reflectane_transparency_5 = ValueList({"0", "1", "2", "3", "4", "5", "6", "7", "8", "9"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}, selected="20")
reflectane_transparency_6 = ValueList({"0", "1", "2", "3", "4", "5", "6", "7", "8", "9"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}, selected="70")
panel_5 = Panel("ceiling")
panel_6 = Panel("frames")
panel_7 = Panel("floor")
cluster_2 = Cluster_2(B=panel_7, C=reflectane_transparency_5)  # -> T, txt_4, txt_5
cluster_3 = Cluster_2(B=panel_6, C=reflectane_transparency_6)  # -> T, txt_4, txt_5
cluster_4 = Cluster_2(B=panel_4, C=reflectane_transparency_3)  # -> T, txt_4, txt_5
cluster_5 = Cluster_2(B=panel_5, C=reflectane_transparency_4)  # -> T, txt_4, txt_5
opaquemod = HBOpaqueModifier(name=cluster_4.txt_4, reflect=cluster_4.txt_5)  # -> modifier; plug-in component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
opaquemod_2 = HBOpaqueModifier(name=cluster_5.txt_4, reflect=cluster_5.txt_5)  # -> modifier; plug-in component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
opaquemod_3 = HBOpaqueModifier(name=cluster_2.txt_4, reflect=cluster_2.txt_5)  # -> modifier; plug-in component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
opaquemod_4 = HBOpaqueModifier(name=cluster_3.txt_4, reflect=cluster_3.txt_5)  # -> modifier; plug-in component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
face = HBFace(geo=cluster_3.T, name=cluster_3.txt_4, rad_mod=opaquemod_4)  # -> report, faces; plug-in component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
face_2 = HBFace(geo=cluster_5.T, name=cluster_5.txt_4, rad_mod=opaquemod_2)  # -> report, faces; plug-in component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
face_3 = HBFace(geo=cluster_2.T, name=cluster_2.txt_4, rad_mod=opaquemod_3)  # -> report, faces; plug-in component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
face_4 = HBFace(geo=cluster_4.T, name=cluster_4.txt_4, rad_mod=opaquemod)  # -> report, faces; plug-in component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
data = Data([face_4.faces, face_2.faces, face_3.faces, face.faces])
clean_2 = CleanTree(RemoveNulls=True, RemoveInvalid=True, RemoveEmpty=True, Tree=data)

# ----
# FUNCTIONAL UNITS
# 01) Daylight
# A) Set up materials and geometries
referencesensorlayer = Panel("0_materials::sensor")
filterbasedongeometry = Panel("""surface
brep
curve""")
central_sim_switch = FalseStartToggle(False)
run_room = Slider(3, range=0..4)

# ----
# Shading
reflectane_transparency_7 = ValueList({"0", "1", "2", "3", "4", "5", "6", "7", "8", "9"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}, selected="20")
reflectane_transparency_8 = ValueList({"0", "1", "2", "3", "4", "5", "6", "7", "8", "9"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}, selected="10")
panel_8 = Panel("terrain")
reflectane_transparency_9 = ValueList({"0", "1", "2", "3", "4", "5", "6", "7", "8", "9"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}, selected="10")
panel_9 = Panel("context")
cluster_6 = Cluster_2(B=panel_9, C=reflectane_transparency_7)  # -> T, txt_4, txt_5
cluster_7 = Cluster_2(B=panel_8, C=reflectane_transparency_9)  # -> T, txt_4, txt_5
opaquemod_5 = HBOpaqueModifier(name=cluster_6.txt_4, reflect=cluster_6.txt_5)  # -> modifier; plug-in component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
opaquemod_6 = HBOpaqueModifier(name=cluster_7.txt_4, reflect=cluster_7.txt_5)  # -> modifier; plug-in component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
shade = HBShade(geo=cluster_7.T, name=cluster_7.txt_4, rad_mod=opaquemod_6)  # -> report, shades; plug-in component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
shade_2 = HBShade(geo=cluster_6.T, name=cluster_6.txt_4, rad_mod=opaquemod_5)  # -> report, shades; plug-in component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
data_2 = Data([shade.shades, shade_2.shades])
clean_3 = CleanTree(RemoveNulls=True, RemoveInvalid=True, RemoveEmpty=True, Tree=data_2)

run_cycle_plug_in = Button()

# ----
# Sensor Surfaces
dpipeline = DynamicGeometryPipeline(
    LayerFilter=graft(referencesensorlayer),
    TypeFilter=filterbasedongeometry,
    NameFilter="*",
    GroupByLayer=False,
    GroupByType=False,
    IncludeHidden=True,
    IncludeLocked=True,
    enableFullPath=True,
    listenToAttributes=True)  # -> flatten(GeometryOut)
lng = ListLength(List=dpipeline)
panel_10 = Panel("if (x>0,True,False)")
# CONTROL WIRES + TURN GROUP ON/OFF
fly = Ladybug_fly(fly=run_cycle_plug_in)  # -> Vviiiiiiiiiizzz; inputs inputSliders: list, fly: Boolean; plug-in component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
panel_11 = Panel(lng)
item = ListItem(List=dpipeline, Index=run_room, Wrap=True)
eval = Evaluate(F=panel_10, x=panel_11)

panel_12 = Panel(cluster_6.txt_4)

distance_from_analysis_surface = ValueList({"0 mm (No offset)": "0mm", "10 mm (Outdoor)": "10mm", "500 mm (BR18 Residential)": "500mm", "550 mm": "550mm", "700 mm": "700mm", "800 mm": "800mm", "850 mm (BR15 + BR18 Office)": "850mm"}, selected="500 mm (BR18 Residential)")
# Analysis Grid
boundary_offset = ValueList({"No offset": "0mm", "BR18 offset (500mm)": "500mm"}, selected="BR18 offset (500mm)")

analysis_mesh_spacing_br18_or_ds_en_1703 = ValueList({"BR18": 0, "DS/EN 17037": 1, "Custom": 2}, selected="Custom")  # "Analysis Mesh Spacing (BR18 or DS/EN 17037)"
analysis_mesh_spacing_max_500mm_in_dk = Panel("2000")
flipnormals = ValueList({"No Flip": "0", "Flip": "1"}, selected="No Flip")

grid_ds_en_17037 = GRIDDSEN17037(brep=item)
data_3 = Data(flatten([grid_ds_en_17037, analysis_mesh_spacing_max_500mm_in_dk]))
U = ConvertToDocumentUnits(ValueString=distance_from_analysis_surface)
docunits = ConvertToDocumentUnits(ValueString=boundary_offset)
max_analysis_mesh_spacing_ds_en_17037 = Panel(data_3)
boundary_offset_2 = Panel(docunits)
distance_from_surface = Panel(U)
python = PythonScript(method=analysis_mesh_spacing_br18_or_ds_en_1703, space=data_3)  # -> out, a; inputs space: list
# ---------- python: Python ----------
import math


if method == 0:
    a=space[0]

elif method == 1:
    a=space[1]

elif method == 2:
    a=space[2]
# ---------- end python ----------
U_2 = ConvertToDocumentUnits(ValueString=python.a)
analysisgrid = AnalysisGrid(A=distance_from_surface, brep=item, D=boundary_offset_2, B_2=U_2, B=flipnormals)  # -> L, L_2, M, A_2, L_3
panel_13 = Panel("Sensors")
sensorgrid = HBSensorGrid(name=panel_13, positions=analysisgrid.L, directions=analysisgrid.L_2, mesh=analysisgrid.M)  # -> grid; plug-in component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

# ----
# Daylight-model
model = HBModel(faces=flatten(clean_2), shades=flatten(clean_3), apertures=flatten(clean), name=name_of_project)  # -> report, model; plug-in component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
vizall = HBVizualizeAll(hb_objs=flatten(clean))  # -> geo; plug-in component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
panel_14 = Panel(model.model)
assigngridsviews = HBAssignGridsAndViews(model=model.model, grids=flatten(sensorgrid))  # -> model; plug-in component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

toggle_3 = FalseStartToggle(False)
toggle_4 = FalseStartToggle(True)
wiredisplay_2 = ControlWireDisplay(
    WireDisplay=Slider(2, range=0..2),
    AllObjects_Object=[max_analysis_mesh_spacing_ds_en_17037, grid_ds_en_17037, distance_from_analysis_surface, distance_from_surface, U, U_2, dpipeline, referencesensorlayer, filterbasedongeometry, analysis_mesh_spacing_max_500mm_in_dk, boundary_offset, docunits, boundary_offset_2, panel_13, analysis_mesh_spacing_br18_or_ds_en_1703, python, fly, lng, panel_11, run_room, sensorgrid, central_sim_switch, item, panel_10, eval, flipnormals, analysisgrid])
hideshow_2 = HideShowObjectPreview(
    Visible=toggle_3,
    AllObjects_Object=[max_analysis_mesh_spacing_ds_en_17037, grid_ds_en_17037, distance_from_analysis_surface, distance_from_surface, U, U_2, dpipeline, referencesensorlayer, filterbasedongeometry, analysis_mesh_spacing_max_500mm_in_dk, boundary_offset, docunits, boundary_offset_2, panel_13, analysis_mesh_spacing_br18_or_ds_en_1703, python, fly, lng, panel_11, run_room, sensorgrid, central_sim_switch, item, panel_10, eval, flipnormals, analysisgrid, data_3, run_cycle_plug_in])
onoff_2 = EnableDisableObject(
    Enabled=toggle_4,
    AllObjects_Object=[max_analysis_mesh_spacing_ds_en_17037, grid_ds_en_17037, distance_from_analysis_surface, distance_from_surface, U, U_2, dpipeline, referencesensorlayer, filterbasedongeometry, analysis_mesh_spacing_max_500mm_in_dk, boundary_offset, docunits, boundary_offset_2, panel_13, analysis_mesh_spacing_br18_or_ds_en_1703, python, fly, lng, panel_11, run_room, sensorgrid, central_sim_switch, item, panel_10, eval, flipnormals, analysisgrid, data_3, run_cycle_plug_in])

toggle_5 = FalseStartToggle(False)
toggle_6 = FalseStartToggle(False)
wiredisplay_3 = ControlWireDisplay(WireDisplay=Slider(2, range=0..2))
hideshow_3 = HideShowObjectPreview(Visible=toggle_5)
onoff_3 = EnableDisableObject(Enabled=toggle_6)

# ----
# B) Simulation Setup
toggle_7 = FalseStartToggle(False)  # disabled
orientation = Slider(0, range=-360..360)  # disabled

# ----
# Simulation Parameters
number_slider = Slider(2, range=0..2)  # disabled
recipte_type = Panel("""0
1""")  # disabled
list = ValueList({"Illuminance (lux)": 0, "Radiation (kWh)": 1, "Luminance  (cd)": 2}, selected="Illuminance (lux)")  # disabled

radpargridbased = HoneybeePlus_RadianceParametersGridBased(complexity=number_slider, recipe_type=recipte_type)  # -> report, rad_par, vmtx_par, dmtx_par, smtx_par; disabled; plug-in component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

# ----
# Recipe
panel_15 = Panel("-ab 3")  # disabled
panel_16 = Panel("-ab 4")  # disabled
panel_17 = Panel("-ab 6")  # disabled
panel_18 = Panel("-ab 7")  # disabled
rep = ReplaceText(Text=radpargridbased.rad_par, Find=panel_15, Replace=panel_16, RecursiveReplace=False)  # disabled
rep_2 = ReplaceText(Text=radpargridbased.dmtx_par, Find=panel_17, Replace=panel_18, RecursiveReplace=False)  # disabled
clean_4 = CleanTree(RemoveNulls=True, RemoveInvalid=True, RemoveEmpty=True, Tree=rep)  # disabled
panel_19 = Panel(clean_4)  # disabled
clean_5 = CleanTree(RemoveNulls=True, RemoveInvalid=True, RemoveEmpty=True, Tree=rep_2)  # disabled
panel_20 = Panel(clean_5)  # disabled

filename = Panel("""Legend
Nr.
Rendered
Sketch
Temp
Results""")

# ----
# Weatherfile and North
open_weather_file = Ladybug_OpenEPWWeatherFile(open=toggle_7)  # -> epwFile; disabled; plug-in component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
importloc = LBImportLocation(epw_file=open_weather_file)  # -> location; disabled; plug-in component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
panel_21 = Panel(importloc)  # disabled

# ----
# Analyze Weather Data
importepw = LBImportEPW(epw_file=open_weather_file)  # -> location, dry_bulb_temperature, dew_point_temperature, relative_humidity, wind_speed, wind_direction, direct_normal_rad, diffuse_horizontal_rad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; disabled; plug-in component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
hourlyplot = LBHourlyPlot(data=[importepw.dry_bulb_temperature, importepw.global_horizontal_ill, importepw.diffuse_horizontal_ill, importepw.direct_normal_ill])  # -> report, mesh, legend, borders, labels, title; disabled; plug-in component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

item_selector = ItemSelector(filename, {"Legend", "Nr.", "Rendered", "Sketch", "Temp", "Results"}, selected="Results")

wea = HBWeaFromEPW(epw_file=open_weather_file)  # -> wea; disabled; plug-in component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

# ----
# Global
panel_22 = Panel("0")  # disabled
panel_23 = Panel("12")  # disabled
panel_24 = Panel("31")  # disabled
panel_25 = Panel("23")  # disabled
panel_26 = Panel("1")  # disabled
panel_27 = Panel("1")  # disabled

# ----
# Analysis period - Set yearly or
# sub-yearly  timespan for analysis
# - make sure your period matches your simulation criteria
analysisperiod = LBAnalysisPeriod(start_month=panel_26, start_day=panel_27, start_hour=panel_22, end_month=panel_23, end_day=panel_24, end_hour=panel_25)  # -> period, hoys, dates; disabled; plug-in component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

# ----
# BR18 Dagslystimer
importepw_2 = LBImportEPW(epw_file=open_weather_file)  # -> location, dry_bulb_temperature, dew_point_temperature, relative_humidity, wind_speed, wind_direction, direct_normal_rad, diffuse_horizontal_rad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; disabled; plug-in component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
xdata = LBDeconstructData(data=importepw_2.global_horizontal_ill)  # -> header, values; disabled; plug-in component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
medianoflist = GhPythonScript(x=xdata.values)  # -> out, a; inputs x: list; disabled
# ---------- medianoflist: Python ----------
__author__ = "ibc"
__version__ = "2020.11.04"

import rhinoscriptsyntax as rs
import statistics

items=x

a=statistics.median(items)

print(a)
#>>> 3
# ---------- end medianoflist ----------
larger = LargerThan(FirstNumber=xdata.values, SecondNumber=medianoflist.a)  # -> LargerThan, OrEqualTo; disabled
panel_28 = Panel("1")  # disabled
int = Integer(larger.OrEqualTo)  # disabled
panel_29 = Panel("BR18_Dagslystimer")  # disabled
fixedintervalschedule = HBFixedIntervalSchedule(values=int, timestep=panel_28, analysis_period=analysisperiod.period, name=panel_29)  # -> report, schedule; disabled; plug-in component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
schtodata = HBScheduleToData(schedule=fixedintervalschedule.schedule)  # -> data; disabled; plug-in component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
xdata_2 = LBDeconstructData(data=schtodata)  # -> header, values; disabled; plug-in component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
panel_30 = Panel(xdata_2.values)  # disabled
ma = MassAddition(Input=panel_30)  # -> Result, PartialResults; disabled
panel_31 = Panel(ma.Result)  # disabled

panel_32 = Panel(int)  # disabled
panel_33 = Panel("C:\Users\ibc\Desktop\Open-source")

toggle_8 = FalseStartToggle(False)
toggle_9 = FalseStartToggle(False)
wiredisplay_4 = ControlWireDisplay(
    WireDisplay=Slider(2, range=0..2),
    AllObjects_Object=[panel_26, panel_27, panel_22, panel_23, panel_24, panel_25, orientation, panel_21, wea, open_weather_file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])
hideshow_4 = HideShowObjectPreview(
    Visible=toggle_8,
    AllObjects_Object=[panel_26, panel_27, panel_22, panel_23, panel_24, panel_25, orientation, panel_21, wea, open_weather_file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])
onoff_4 = EnableDisableObject(
    Enabled=toggle_9,
    AllObjects_Object=[panel_26, panel_27, panel_22, panel_23, panel_24, panel_25, orientation, panel_21, wea, open_weather_file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])

# ---- group: Orientering
cluster_8 = Cluster(x=orientation)  # -> pt_2, V; disabled

# ----
# Set North
swatch = ColourSwatch(SwatchColor=RGB(58, 140, 255))  # disabled
panel_34 = Panel("10")  # disabled
unit = UnitVector(Vector=cluster_8.V)  # disabled
vdisex = VectorDisplayEx(Point=cluster_8.pt_2, Vector=cluster_8.V, Colour=swatch, Width=panel_34)  # disabled

countcpus = CountCpus()  # -> AllCpus, CpusMinusOne, CpusMinusTwo, CpusThirds; disabled
# ---------- countcpus: Python ----------
__author__ = "ibc"
__version__ = "2020.11.04"

import rhinoscriptsyntax as rs

import System
count = System.Environment.ProcessorCount

AllCpus = count
CpusMinusOne = count-1
CpusMinusTwo = count -2  
CpusThirds = round(count/3)
# ---------- end countcpus ----------

name_of_dc_sim = Panel("Usefull Daylight Illuminance")  # disabled
toggle_10 = FalseStartToggle(False)  # disabled
list_2 = ValueList({"Threshold: BREEAM (100 lux)": 100, "Threshold: BR18 (300 lux)": 300, "Threshold: High (1000 lux)": 1000, "Threshold: Very High (3000)": 3000}, selected="Threshold: BR18 (300 lux)")  # disabled
and = GateAnd(A=central_sim_switch, B=toggle_10)  # disabled

# ----
# b) Usefull Daylight Autonomy
# Run the simulation
annualdaylight = HBAnnualDaylight(model=assigngridsviews, wea=wea, north=unit, sensor_count=200, radiance_parameters=panel_20)  # -> recipe; disabled; plug-in component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
runrecipe = HBRunRecipe(recipe=annualdaylight, cpu_count=countcpus.CpusThirds, run=and)  # -> report, results; disabled; plug-in component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

# ----
# 3) Dynamic daylight calculations
toggle_11 = FalseStartToggle(False)
toggle_12 = FalseStartToggle(False)
hideshow_5 = HideShowObjectPreview(
    Visible=toggle_11,
    AllObjects_Object=[name_of_dc_sim_2, annualdaylight_2, runrecipe_2, toggle_13, area_2, match_2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])
wiredisplay_5 = ControlWireDisplay(
    WireDisplay=Slider(2, range=0..2),
    AllObjects_Object=[name_of_dc_sim_2, annualdaylight_2, runrecipe_2, toggle_13, area_2, match_2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])
onoff_5 = EnableDisableObject(
    Enabled=toggle_12,
    AllObjects_Object=[name_of_dc_sim_2, annualdaylight_2, runrecipe_2, toggle_13, area_2, match_2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])

countcpus_2 = CountCpus()  # -> AllCpus, CpusMinusOne, CpusMinusTwo, CpusThirds; disabled; same code as countcpus

name_of_dc_sim_2 = Panel("Daylight_Autonomy")  # disabled
list_3 = ValueList({"Threshold: BREEAM (100 lux)": 100, "Threshold: BR18 (300 lux)": 300, "Threshold: High (1000 lux)": 1000, "Threshold: Very High (3000)": 3000}, selected="Threshold: BR18 (300 lux)")  # disabled
toggle_13 = FalseStartToggle(False)  # disabled
and_2 = GateAnd(A=central_sim_switch, B=toggle_13)  # disabled

# ----
# a) Daylight Autonomy
# Run the simulation
annualdaylight_2 = HBAnnualDaylight(model=assigngridsviews, wea=wea, north=unit, sensor_count=200, radiance_parameters=panel_20)  # -> recipe; disabled; plug-in component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
runrecipe_2 = HBRunRecipe(recipe=annualdaylight_2, cpu_count=countcpus_2.CpusThirds, run=toggle_13)  # -> report, results; disabled; plug-in component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
annualmetrics = HBAnnualDaylightMetrics(results=runrecipe_2.results, occ_sch=fixedintervalschedule.schedule, threshold=list_3)  # -> report, DA, UDI; disabled; plug-in component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

# ----
# Run Daylight Factor
name_of_df_sim = Panel("Daylight_Factor")  # disabled
toggle_14 = FalseStartToggle(False)  # disabled
and_3 = GateAnd(A=central_sim_switch, B=toggle_14)  # disabled

# ----
# Run the simulation
daylightfactor = HBDaylightFactor(model=assigngridsviews, sensor_count=200, radiance_parameters="-ab 2")  # -> recipe; disabled; plug-in component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
countcpus_3 = CountCpus()  # -> AllCpus, CpusMinusOne, CpusMinusTwo; disabled
# ---------- countcpus_3: Python ----------
__author__ = "ibc"
__version__ = "2020.11.04"

import rhinoscriptsyntax as rs

import System
count = System.Environment.ProcessorCount

AllCpus = count
CpusMinusOne = count-1
CpusMinusTwo = count -2
# ---------- end countcpus_3 ----------
runrecipe_3 = HBRunRecipe(recipe=daylightfactor, cpu_count=countcpus_3.CpusMinusOne, run=toggle_14)  # -> report, results; disabled; plug-in component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
file = ReadFile(File=runrecipe_3.results, PerLineParse=True)  # disabled
panel_35 = Panel(file)  # disabled

# ----
# Mesh, results and analysis surface
mesh = Mesh(simplify(graft(analysisgrid.M)))  # disabled
test_surfaces = Brep(item)  # disabled
results = Number(simplify(file))  # disabled
pt = Point(analysisgrid.L)  # disabled
area = Area(Geometry=mesh)  # -> Area, Centroid; disabled
match = MatchTree(Tree=results, Guide=mesh)  # disabled
panel_36 = Panel(match)  # disabled

# ----
# C) Simulations
# 1.a) Direct Daylight Study
# Analysisperiod (local)
list_4 = ValueList({"Determine analysis period locally": 0, "Determine analysis period globally": 1}, selected="Determine analysis period locally")
number_slider_2 = Slider(3, range=0..10)
number_slider_3 = Slider(21, range=0..100)
analysisperiod_2 = LBAnalysisPeriod(
    start_month=number_slider_2,
    start_day=number_slider_3,
    start_hour=Slider(0, range=0..23),
    end_month=number_slider_2,
    end_day=number_slider_3,
    end_hour=Slider(23, range=0..23))  # -> period, hoys, dates; plug-in component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

toggle_15 = FalseStartToggle(False)
toggle_16 = FalseStartToggle(False)
wiredisplay_6 = ControlWireDisplay(
    WireDisplay=Slider(2, range=0..2),
    AllObjects_Object=[annualmetrics_2, udi_f, udi_s, udi_c, udi_e, for_explanation_dobuble_click_me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])
hideshow_6 = HideShowObjectPreview(
    Visible=toggle_15,
    AllObjects_Object=[annualmetrics_2, udi_f, udi_s, udi_c, udi_e, for_explanation_dobuble_click_me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])
onoff_6 = EnableDisableObject(
    Enabled=toggle_16,
    AllObjects_Object=[annualmetrics_2, udi_f, udi_s, udi_c, udi_e, for_explanation_dobuble_click_me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])

# ----
# 2) Daylight Factor
toggle_17 = FalseStartToggle(False)
toggle_18 = FalseStartToggle(False)
wiredisplay_7 = ControlWireDisplay(
    WireDisplay=Slider(2, range=0..2),
    AllObjects_Object=[df_for_area_to_surpass, panel_35, area, mesh, results, match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])
hideshow_7 = HideShowObjectPreview(Visible=toggle_17, AllObjects_Object=[df_for_area_to_surpass, panel_35, area, mesh, results, match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])
onoff_7 = EnableDisableObject(Enabled=toggle_18, AllObjects_Object=[df_for_area_to_surpass, panel_35, area, mesh, results, match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])

for_explanation_dobuble_click_me = ForExplanationDobubleClickMe()  # disabled
udi_c = Panel("""100
2000""")  # disabled
udi_s = Panel("""100
300""")  # disabled
udi_f = Panel("""0
100""")  # disabled
udi_a = Panel("""300
2000""")  # disabled
udi_e = Panel("""2000
100000""")  # disabled

entwine = Entwine(Branch00=udi_f, Branch01=udi_s, Branch02=udi_a, Branch03=udi_c, Branch04=udi_e, FlattenInputs=True)  # disabled
annualmetrics_2 = HBAnnualDaylightMetrics(results=runrecipe.results, occ_sch=fixedintervalschedule.schedule, min_max=udi_c)  # -> report, DA, UDI; disabled; plug-in component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

lng_2 = ListLength(List=annualmetrics_2.UDI)  # disabled
division = Division(A=lng_2, B=5)  # disabled
partition = PartitionList(List=annualmetrics_2.UDI, Size=division)  # disabled

# ----
# IsoCurve and Gradient mesh
toggle_19 = BooleanToggle(False)
topography_v_1_0 = TopographyV10(srf=analysisgrid.L_3, pt=pt, results=file, B=toggle_19)  # -> remapped_numbers_2, vertices_2, face_2, colors_2, mesh_3, crv_6, pln_2; disabled
project = Project(Geometry=simplify(topography_v_1_0.crv_6), Plane=area.Centroid)  # -> Geometry, Transform; disabled
project_2 = Project(Geometry=topography_v_1_0.mesh_3, Plane=area.Centroid)  # -> Geometry, Transform; disabled

# ----
# Mesh, results and analysis surface
results_2 = Number()  # disabled
test_surfaces_2 = Brep(analysisgrid.L_3)  # disabled
mesh_2 = Mesh(simplify(graft(analysisgrid.M)))  # disabled
pt_2 = Point()  # disabled
match_2 = MatchTree(Tree=results_2, Guide=mesh_2)  # disabled
area_2 = Area(Geometry=mesh_2)  # -> Area, Centroid; disabled
panel_37 = Panel(match_2)  # disabled

# ----
# Set Simulation Goals
list_5 = ValueList({"Low Target (20%)": 20, "BR18 Target (50%)": 50, "BREEAM target (80%)": 80, "High Target DS/EN 17037": 95}, selected="BR18 Target (50%)")  # disabled
equal_to_or_bigger_than = Panel(">=")  # disabled

panel_38 = Panel("100")  # disabled
meshselector = Ladybug_MeshThresholdSelector(
    inputMesh=mesh_2,
    analysisResult=match_2,
    operator=equal_to_or_bigger_than,
    percentToKeep=panel_38,
    levelOfPerform=list_5)  # -> readMe, totalValue, areaMeetsThresh, newColoredMesh, newMeshOutline; disabled; plug-in component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

# ----
# Set Simulation Goals
list_6 = ValueList({"Low Target (20%)": 20, "BR18 Target (50%)": 50, "BREEAM target (80%)": 80, "High Target DS/EN 17037": 95}, selected="BR18 Target (50%)")  # disabled
equal_to_or_bigger_than_2 = Panel(">=")  # disabled

# ----
# Mesh, results and analysis surface
pt_3 = Point(analysisgrid.L)  # disabled
mesh_3 = Mesh(simplify(graft(analysisgrid.M)))  # disabled
test_surfaces_3 = Brep(item)  # disabled
results_3 = Number(simplify(annualmetrics_2.UDI))  # disabled
area_3 = Area(Geometry=mesh_3)  # -> Area, Centroid; disabled
panel_39 = Panel(results_3)  # disabled

panel_40 = Panel("100")  # disabled
panel_41 = Panel(">=")  # disabled
meshselector_2 = Ladybug_MeshThresholdSelector(inputMesh=mesh_3, analysisResult=results_3, operator=panel_41, percentToKeep=panel_40, levelOfPerform=list_6)  # -> readMe, totalValue, areaMeetsThresh, newColoredMesh, newMeshOutline; disabled; plug-in component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

toggle_20 = FalseStartToggle(False)
toggle_21 = FalseStartToggle(False)
wiredisplay_8 = ControlWireDisplay(WireDisplay=Slider(2, range=0..2))
hideshow_8 = HideShowObjectPreview(
    Visible=toggle_20,
    AllObjects_Object=[number_slider_4, flatten, analemma, swatch_2, daily, compass, preview, sun_pts, preview_2, preview_3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])
onoff_8 = EnableDisableObject(
    Enabled=toggle_21,
    AllObjects_Object=[number_slider_4, flatten, analemma, swatch_2, daily, compass, preview, sun_pts, preview_2, preview_3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])

equal_to_or_bigger_than_3 = Panel(">=")  # disabled
# Set Simulation Goals
df_for_area_to_surpass = Panel("2")  # disabled

panel_42 = Panel("100")  # disabled
meshselector_3 = Ladybug_MeshThresholdSelector(
    inputMesh=mesh,
    analysisResult=match,
    operator=equal_to_or_bigger_than_3,
    percentToKeep=panel_42,
    levelOfPerform=df_for_area_to_surpass)  # -> readMe, totalValue, areaMeetsThresh, newColoredMesh, newMeshOutline; disabled; plug-in component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

# ----
# Uniformity
avr = Average(Input=results_2)  # disabled
bnd = Bounds(Numbers=results_2)  # disabled
dedomain = DeconstructDomain(Domain=bnd)  # -> Start, End; disabled
division_2 = Division(A=dedomain.Start, B=avr)  # disabled

# ----
# Uniformity
bnd_2 = Bounds(Numbers=results_3)  # disabled
avr_2 = Average(Input=results_3)  # disabled
dedomain_2 = DeconstructDomain(Domain=bnd_2)  # -> Start, End; disabled
division_3 = Division(A=dedomain_2.Start, B=avr_2)  # disabled

daylight_factor = Expression(x=avr_2, Expression="Format(\"The floor area has an average usefull daylight illuminance of {0:0}%\",x)")  # disabled
daylight_factor_2 = Expression(
    x=area_3.Area,
    y=meshselector_2.areaMeetsThresh,
    z=list_6,
    Expression="Format(\"{00:0}% of the floor area is above UDI {1}%\", y/x*100, z)")  # disabled

daylight_factor_3 = Expression(x=avr, Expression="Format(\"The floor area has an average daylight autonomy of {0:0}%\",x)")  # disabled
daylight_factor_4 = Expression(
    x=area_2.Area,
    y=meshselector.areaMeetsThresh,
    z=list_5,
    Expression="Format(\"{00:0}% of the floor area is above DA {1}%\", y/x*100, z)")  # disabled

# ----
# IsoCurve and Gradient mesh
topography_v_1_0_2 = TopographyV10_2(srf=test_surfaces_2, pt=pt_2, results=results_2)  # -> remapped_numbers_2, vertices_2, face_2, colors_2, mesh_3, crv_6, pln_2; disabled
project_3 = Project(Geometry=simplify(topography_v_1_0_2.crv_6), Plane=topography_v_1_0_2.pln_2)  # -> Geometry, Transform; disabled
project_4 = Project(Geometry=topography_v_1_0_2.mesh_3, Plane=topography_v_1_0_2.pln_2)  # -> Geometry, Transform; disabled
group = Group(Objects=flatten(project_3.Geometry))  # disabled
group_2 = Group(Objects=project_4.Geometry)  # disabled

# ----
# Uniformity
avr_3 = Average(Input=results)  # disabled
bnd_3 = Bounds(Numbers=results)  # disabled
dedomain_3 = DeconstructDomain(Domain=bnd_3)  # -> Start, End; disabled
division_4 = Division(A=dedomain_3.Start, B=avr_3)  # disabled

# ----
# IsoCurve and Gradient mesh
topography_v_1_0_3 = TopographyV10_2(srf=analysisgrid.L_3, pt=pt_3, results=results_3)  # -> remapped_numbers_2, vertices_2, face_2, colors_2, mesh_3, crv_6, pln_2; disabled
project_5 = Project(Geometry=simplify(topography_v_1_0_3.crv_6), Plane=area_3.Centroid)  # -> Geometry, Transform; disabled
project_6 = Project(Geometry=topography_v_1_0_3.mesh_3, Plane=area_3.Centroid)  # -> Geometry, Transform; disabled
group_3 = Group(Objects=flatten(project_5.Geometry))  # disabled
group_4 = Group(Objects=project_6.Geometry)  # disabled

daylight_factor_5 = Expression(x=avr_3, Expression="Format(\"The floor area has an average daylight factor of {0:0}%\",x)")  # disabled
daylight_factor_6 = Expression(
    x=area.Area,
    y=meshselector_3.areaMeetsThresh,
    z=df_for_area_to_surpass,
    Expression="Format(\"{00:0}% of the floor area is above DF {1}%\", y/x*100, z)")  # disabled

# ----
# Legend
panel_43 = Panel(name_of_df_sim)  # disabled
panel_44 = Panel("24")  # disabled
panel_45 = Panel("0")  # disabled
panel_46 = Panel("0")  # disabled
panel_47 = Panel("7")  # disabled
legendpar = LBLegendParameters(min=panel_46, max=panel_44, seg_count=panel_47, colors=topography_v_1_0.colors_2, num_decimals=panel_45)  # -> leg_par; disabled; plug-in component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
heatmap = LBSpatialHeatmap(values=results, mesh=mesh, legend_par=legendpar, legend_title=panel_43, global_title=daylight_factor_5)  # -> mesh, legend, title, colors, legend_par; disabled; plug-in component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
data_4 = Data([heatmap.legend, heatmap.title])  # disabled

faceb = FaceBoundaries(Mesh=mesh_2)  # disabled
area_4 = Area(Geometry=faceb)  # -> simplify(graft(Area)), Centroid; disabled

# ----
# Area
division_5 = Division(A=meshselector.areaMeetsThresh, B=area_2.Area)  # disabled
panel_48 = Panel("mm2")  # disabled
panel_49 = Panel("m2")  # disabled
ma_2 = MassAddition(Input=flatten(area_4.Area))  # -> Result, PartialResults; disabled
units = LBUnitConverter(values=ma_2.Result, from_u=panel_48, to_u=panel_49)  # -> all_u, values; disabled; plug-in component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
cluster_9 = Cluster_7(L=ma_2.Result, L_2=units.values, A=U_2)  # -> L_3, L_4; disabled
data_5 = Data([cluster_9.L_3, cluster_9.L_4])  # disabled

faceb_2 = FaceBoundaries(Mesh=mesh_3)  # disabled
area_5 = Area(Geometry=faceb_2)  # -> simplify(Area), Centroid; disabled

# ----
# Area
division_6 = Division(A=meshselector_2.areaMeetsThresh, B=area_3.Area)  # disabled
panel_50 = Panel("m2")  # disabled
panel_51 = Panel("mm2")  # disabled
ma_3 = MassAddition(Input=flatten(area_5.Area))  # -> Result, PartialResults; disabled
units_2 = LBUnitConverter(values=ma_3.Result, from_u=panel_51, to_u=panel_50)  # -> all_u, values; disabled; plug-in component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
cluster_10 = Cluster_7(L=ma_3.Result, L_2=units_2.values, A=distance_from_surface)  # -> L_3, L_4; disabled
data_6 = Data([cluster_10.L_3, cluster_10.L_4])  # disabled

# ---- group: Run me!
analyseflader = Panel("Overflade")  # disabled
skyggegivere = Panel("""0_context_0.20
0_wall_0.50
0_floor_0.20
0_ceiling_0.70""")  # disabled
falsestart = Ladybug_FalseStartToggle(False)  # disabled

# ----
# Run Direct Sun Study
number_slider_4 = Slider(2, range=0..10)  # disabled
simple_yes_no = SimpleYesNo(bool=list_4, Local=analysisperiod_2.hoys, Global=analysisperiod.hoys)  # -> out, flatten(a); inputs bool: Boolean, Local: list, Global: list; disabled
# ---------- simple_yes_no: Python ----------
import math


if bool == False:
    a=Local

if bool == True:
    a=Global
# ---------- end simple_yes_no ----------
flatten = FlattenTree(Tree=simple_yes_no.a, Path="{0}")  # disabled
sunpath = LBSunPath(north=unit, location=importloc, hoys=flatten, scale=number_slider_4)  # -> report, vectors, altitudes, azimuths, hoys, sun_pts, analemma, daily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; disabled; plug-in component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
panel_52 = Panel("{0,0,0}")  # disabled
vec2pt = Vector2Pt(PointA=panel_52, PointB=sunpath.sun_pts, Unitize=False)  # -> Vector, Length; disabled
vdisex_2 = VectorDisplayEx(Point=panel_52, Vector=vec2pt.Vector, Colour=RGB(0, 0, 0), Width=2)  # disabled
cluster_11 = Cluster_3(B=analyseflader, B_2=skyggegivere)  # -> T, G; disabled
panel_53 = Panel("10mm")  # disabled
panel_54 = Panel("10000mm")  # disabled
brep_3 = Brep([<brep referenced from the Rhino model> x3])
docunits_2 = ConvertToDocumentUnits(ValueString=panel_54)  # disabled
docunits_3 = ConvertToDocumentUnits(ValueString=panel_53)  # disabled
directsunhours = LBDirectSunHours(
    vectors=flatten(sunpath.vectors),
    geometry=flatten(cluster_11.T),
    context=flatten(cluster_11.G),
    grid_size=docunits_2,
    offset_dist=docunits_3,
    parallel=falsestart,
    run=falsestart)  # -> report, points, results, mesh, legend, title, int_mtx; disabled; plug-in component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
data_7 = Data(directsunhours.legend)  # disabled

number_slider_5 = Slider(0, range=0..360)

faceb_3 = FaceBoundaries(Mesh=mesh)  # disabled
area_6 = Area(Geometry=faceb_3)  # -> simplify(graft(Area)), Centroid; disabled

# ----
# Area
panel_55 = Panel("m2")  # disabled
panel_56 = Panel("mm2")  # disabled
ma_4 = MassAddition(Input=flatten(area_6.Area))  # -> Result, PartialResults; disabled
units_3 = LBUnitConverter(values=ma_4.Result, from_u=panel_55, to_u=panel_56)  # -> all_u, values; disabled; plug-in component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
cluster_12 = Cluster_7(L=ma_4.Result, L_2=units_3.values, A=distance_from_surface)  # -> L_3, L_4; disabled
data_8 = Data([cluster_12.L_3, cluster_12.L_4])  # disabled

# ----
# Legend
panel_57 = Panel(name_of_dc_sim)  # disabled
panel_58 = Panel("0")  # disabled
panel_59 = Panel("0")  # disabled
panel_60 = Panel("100")  # disabled
panel_61 = Panel("11")  # disabled
legendpar_2 = LBLegendParameters(min=panel_59, max=panel_60, seg_count=panel_61, colors=topography_v_1_0_3.colors_2, num_decimals=panel_58)  # -> leg_par; disabled; plug-in component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
heatmap_2 = LBSpatialHeatmap(values=results_3, mesh=mesh_3, legend_par=legendpar_2, legend_title=panel_57, global_title=daylight_factor_2)  # -> mesh, legend, title, colors, legend_par; disabled; plug-in component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
data_9 = Data(heatmap_2.legend)  # disabled
data_10 = Data([heatmap_2.legend, heatmap_2.title])  # disabled

room_area_m2 = Panel(data_5)  # disabled
sudd_area = Panel(area_4.Area)  # disabled
average_da = Panel(avr)  # disabled
area_above_50_da = Panel(daylight_factor_4)  # disabled
lowest_df_of_room_da = Panel(dedomain.Start)  # disabled
uniformity = Panel(division_2)  # disabled

# ----
# Legend
panel_62 = Panel("0")  # disabled
panel_63 = Panel("100")  # disabled
panel_64 = Panel("11")  # disabled
panel_65 = Panel("0")  # disabled
panel_66 = Panel(name_of_dc_sim_2)  # disabled
legendpar_3 = LBLegendParameters(min=panel_62, max=panel_63, seg_count=panel_64, num_decimals=panel_65)  # -> leg_par; disabled; plug-in component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
heatmap_3 = LBSpatialHeatmap(values=results_2, mesh=mesh_2, legend_par=legendpar_3, legend_title=panel_66, global_title=daylight_factor_4)  # -> mesh, legend, title, colors, legend_par; disabled; plug-in component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
data_11 = Data([heatmap_3.legend, heatmap_3.title])  # disabled

room_area_m2_2 = Panel(data_6)  # disabled
sudd_area_2 = Panel(area_5.Area)  # disabled
area_above_50_da_2 = Panel(daylight_factor_2)  # disabled
average_da_2 = Panel(avr_2)  # disabled
lowest_df_of_room_da_2 = Panel(dedomain_2.Start)  # disabled
uniformity_2 = Panel(division_3)  # disabled

room_area_m2_3 = Panel(data_8)  # disabled
sudd_area_3 = Panel(area_6.Area)  # disabled
average_df = Panel(avr_3)  # disabled
area_above_2_df = Panel(daylight_factor_6)  # disabled
uniformity_3 = Panel(division_4)  # disabled
lowest_df_of_room_df = Panel(dedomain_3.Start)  # disabled

# ----
# Bake To Layers
mesh_contour = FalseStartToggle(False)  # disabled
panel_67 = Panel("01_daylight_Results::DF")  # disabled
results_4 = FalseStartToggle(False)  # disabled

toggle_22 = FalseStartToggle(False)
hideshow_9 = HideShowObjectPreview(Visible=toggle_22)

swatch_2 = ColourSwatch(SwatchColor=RGB(241, 255, 0))  # disabled
swatch_3 = ColourSwatch(SwatchColor=RGB(53, 35, 162))  # disabled
sun_pts = Point(sunpath.sun_pts)  # disabled
swatch_4 = ColourSwatch(SwatchColor=RGB(4, 0, 0))  # disabled
analemma = Curve(sunpath.analemma)  # disabled
compass = Geometry(sunpath.compass)  # disabled
swatch_5 = ColourSwatch(SwatchColor=RGB(6, 0, 162))  # disabled
daily = Curve(sunpath.daily)  # disabled
cull = CullPattern(
    List=sun_pts,
    CullPattern=[False, False, False, False, False, False, True, False, False, False, False, False, False, False, True])  # disabled
preview = CustomPreview(Geometry=analemma, Material=swatch_3)  # disabled
preview_2 = CustomPreview(Geometry=daily, Material=swatch_5)  # disabled
preview_3 = CustomPreview(Geometry=compass, Material=swatch_4)  # disabled
preview_4 = CustomPreview(Geometry=cull, Material=swatch_2)  # disabled

and_4 = GateAnd(A=results_4, B=toggle_14)  # disabled

and_5 = GateAnd(A=mesh_contour, B=toggle_14)  # disabled

toggle_23 = FalseStartToggle(False)  # disabled
hideshow_10 = HideShowObjectPreview(Visible=toggle_23)  # disabled

# ----
# Bake To Layers
panel_68 = Panel("01_daylight_Results::DA")  # disabled
mesh_contour_2 = FalseStartToggle(False)  # disabled
results_5 = FalseStartToggle(False)  # disabled

# ----
# Mesh
panel_69 = Panel("01_daylight_Results::Sunacces::Direct_sun_simulation")  # disabled
toggle_24 = FalseStartToggle(False)  # disabled
panel_70 = Panel("Sun Mesh")  # disabled
onoff_9 = EnableDisableObject(Enabled=toggle_24)  # disabled
swatch_6 = ColourSwatch(SwatchColor=RGB(0, 0, 0))  # disabled
layers = CreateModifyLayers(LayerName=panel_69, DeleteLayer=False, enableFullPath=True)  # -> LayerNames, LayerFullPath; disabled
createatts = CreateAttributes(Name=panel_70, LayerName=layers.LayerFullPath, Color=swatch_6, enableFullPath=True)  # disabled
bake = BakeObject(ObjectAttributes=createatts, Bake=toggle_24)  # disabled

# ----
# Bake To Layers
mesh_contour_3 = FalseStartToggle(False)  # disabled
results_6 = FalseStartToggle(False)  # disabled

panel_71 = Panel("01_daylight_Results::UDI")  # disabled
and_6 = GateAnd(A=mesh_contour_3, B=toggle_10)  # disabled
and_7 = GateAnd(A=results_6, B=toggle_10)  # disabled

and_8 = GateAnd(A=results_5, B=toggle_13)  # disabled

and_9 = GateAnd(A=mesh_contour_2, B=toggle_13)  # disabled

toggle_25 = FalseStartToggle(False)
toggle_26 = FalseStartToggle(False)
enable_disable_object = EnableDisableObject(Enabled=toggle_26)
hideshow_11 = HideShowObjectPreview(Visible=toggle_25)

value_list = ValueList({"Default", "Default 01"}, selected="Default")  # disabled
panel_72 = Panel("::Sub Results")  # disabled

value_list_2 = ValueList({"Default", "Default 01"}, selected="Default 01")  # disabled
panel_73 = Panel("::Room Result")  # disabled

panel_74 = Panel("::Mesh")  # disabled
concat = Concatenate(FragmentA=panel_67, FragmentB=panel_74)  # disabled
define_object_attributes = DefineObjectAttributes(Layer=concat)  # disabled
bake_objects = BakeObjects(Geometry=project_2.Geometry, Attributes=define_object_attributes, Bake=and_5)  # disabled

lng_3 = ListLength(List=pt)  # disabled
round = Round(Number=expr("x*100", division_4))  # -> Nearest, Floor, Ceiling; disabled
panel_75 = Panel("2")  # disabled
division_7 = Division(A=lng_3, B=panel_75)  # disabled
concat_2 = Concatenate(FragmentA=panel_67, FragmentB=panel_73)  # disabled
round_2 = Round(Number=division_7)  # -> Nearest, Floor, Ceiling; disabled
panel_76 = Panel("%")  # disabled
concat_3 = Concatenate(FragmentA=round.Nearest, FragmentB=panel_76)  # disabled
item_2 = ListItem(List=pt, Index=round_2.Nearest, Wrap=True)  # disabled
define_text_object = DefineTextObject(Text=concat_3, Plane=item_2, DimensionStyle=value_list_2, OutputType="Text")  # disabled
define_object_attributes_2 = DefineObjectAttributes(Layer=concat_2)  # disabled
group_5 = Group(Objects=define_text_object)  # disabled
bake_modify_layer = BakeModifyLayer(Layer=concat_2, Bake=and_4)  # disabled
bake_objects_2 = BakeObjects(Geometry=group_5, Attributes=define_object_attributes_2, Bake=and_4)  # disabled

value_list_3 = ValueList({"Default", "Default 01"}, selected="Default 01")  # disabled
panel_77 = Panel("::Room Result")  # disabled

toggle_27 = FalseStartToggle(False)
toggle_28 = FalseStartToggle(False)
enable_disable_object_2 = EnableDisableObject(Enabled=toggle_28)
hideshow_12 = HideShowObjectPreview(Visible=toggle_27)

value_list_4 = ValueList({"Default", "Default 01"}, selected="Default 01")  # disabled
panel_78 = Panel("::Sub Results")  # disabled

panel_79 = Panel("::Mesh")  # disabled
concat_4 = Concatenate(FragmentA=panel_68, FragmentB=panel_79)  # disabled
define_object_attributes_3 = DefineObjectAttributes(Layer=concat_4)  # disabled
bake_objects_3 = BakeObjects(Geometry=group_2, Attributes=define_object_attributes_3, Bake=and_9)  # disabled

round_3 = Round(Number=results)  # -> Nearest, Floor, Ceiling; disabled
concat_5 = Concatenate(FragmentA=panel_67, FragmentB=panel_72)  # disabled
define_text_object_2 = DefineTextObject(Text=round_3.Nearest, Plane=pt, DimensionStyle=value_list, OutputType="Text")  # disabled
define_object_attributes_4 = DefineObjectAttributes(Layer=concat_5)  # disabled
group_6 = Group(Objects=define_text_object_2)  # disabled
bake_objects_4 = BakeObjects(Geometry=group_6, Attributes=define_object_attributes_4, Bake=and_4)  # disabled
bake_modify_layer_2 = BakeModifyLayer(Layer=concat_5, Bake=and_4)  # disabled

toggle_29 = FalseStartToggle(False)
toggle_30 = FalseStartToggle(False)
onoff_10 = EnableDisableObject(Enabled=toggle_30)
hideshow_13 = HideShowObjectPreview(Visible=toggle_29)

value_list_5 = ValueList({"Default", "Default 01"}, selected="Default")  # disabled
panel_80 = Panel("::Sub Results")  # disabled

value_list_6 = ValueList({"Default", "Default 01"}, selected="Default 01")  # disabled
panel_81 = Panel("::Room Result")  # disabled

panel_82 = Panel("::Mesh")  # disabled
concat_6 = Concatenate(FragmentA=panel_71, FragmentB=panel_82)  # disabled
define_object_attributes_5 = DefineObjectAttributes(Layer=concat_6)  # disabled
bake_objects_5 = BakeObjects(Geometry=group_4, Attributes=define_object_attributes_5, Bake=and_6)  # disabled

panel_83 = Panel("::Contour")  # disabled
concat_7 = Concatenate(FragmentA=panel_67, FragmentB=panel_83)  # disabled
define_object_attributes_6 = DefineObjectAttributes(Layer=concat_7)  # disabled
bake_objects_6 = BakeObjects(Geometry=project.Geometry, Attributes=define_object_attributes_6, Bake=and_5)  # disabled

lng_4 = ListLength(List=pt_2)  # disabled
round_4 = Round(Number=expr("x*100", division_5))  # -> Nearest, Floor, Ceiling; disabled
panel_84 = Panel("2")  # disabled
division_8 = Division(A=lng_4, B=panel_84)  # disabled
concat_8 = Concatenate(FragmentA=panel_68, FragmentB=panel_77)  # disabled
panel_85 = Panel("%")  # disabled
round_5 = Round(Number=division_8)  # -> Nearest, Floor, Ceiling; disabled
concat_9 = Concatenate(FragmentA=round_4.Nearest, FragmentB=panel_85)  # disabled
item_3 = ListItem(List=pt_2, Index=round_5.Nearest, Wrap=True)  # disabled
define_text_object_3 = DefineTextObject(Text=concat_9, Plane=item_3, DimensionStyle=value_list_3, OutputType="Text")  # disabled
define_object_attributes_7 = DefineObjectAttributes(Layer=concat_8)  # disabled
group_7 = Group(Objects=define_text_object_3)  # disabled
bake_modify_layer_3 = BakeModifyLayer(Layer=concat_8, Bake=and_8)  # disabled
bake_objects_7 = BakeObjects(Geometry=group_7, Attributes=define_object_attributes_7, Bake=and_8)  # disabled

concat_10 = Concatenate(FragmentA=panel_68, FragmentB=panel_78)  # disabled
round_6 = Round(Number=results_2)  # -> Nearest, Floor, Ceiling; disabled
define_text_object_4 = DefineTextObject(Text=round_6.Nearest, Plane=pt_2, DimensionStyle=value_list_4, OutputType="Text")  # disabled
define_object_attributes_8 = DefineObjectAttributes(Layer=concat_10)  # disabled
group_8 = Group(Objects=define_text_object_4)  # disabled
bake_modify_layer_4 = BakeModifyLayer(Layer=concat_10, Bake=and_8)  # disabled
bake_objects_8 = BakeObjects(Geometry=group_8, Attributes=define_object_attributes_8, Bake=and_8)  # disabled

lng_5 = ListLength(List=pt_3)  # disabled
round_7 = Round(Number=expr("x*100", division_6))  # -> Nearest, Floor, Ceiling; disabled
panel_86 = Panel("2")  # disabled
division_9 = Division(A=lng_5, B=panel_86)  # disabled
concat_11 = Concatenate(FragmentA=panel_71, FragmentB=panel_81)  # disabled
round_8 = Round(Number=division_9)  # -> Nearest, Floor, Ceiling; disabled
panel_87 = Panel("%")  # disabled
concat_12 = Concatenate(FragmentA=round_7.Nearest, FragmentB=panel_87)  # disabled
item_4 = ListItem(List=pt_3, Index=round_8.Nearest, Wrap=True)  # disabled
define_text_object_5 = DefineTextObject(Text=concat_12, Plane=item_4, DimensionStyle=value_list_6, OutputType="Text")  # disabled
define_object_attributes_9 = DefineObjectAttributes(Layer=concat_11)  # disabled
group_9 = Group(Objects=define_text_object_5)  # disabled
bake_modify_layer_5 = BakeModifyLayer(Layer=concat_11, Bake=and_7)  # disabled
bake_objects_9 = BakeObjects(Geometry=group_9, Attributes=define_object_attributes_9, Bake=and_7)  # disabled

# ----
# 1.b) Radiation Study
toggle_31 = FalseStartToggle(False)
toggle_32 = FalseStartToggle(False)
wiredisplay_9 = ControlWireDisplay(WireDisplay=Slider(2, range=0..2))
hideshow_14 = HideShowObjectPreview(Visible=toggle_31)
onoff_11 = EnableDisableObject(Enabled=toggle_32)

round_9 = Round(Number=results_3)  # -> Nearest, Floor, Ceiling; disabled
concat_13 = Concatenate(FragmentA=panel_71, FragmentB=panel_80)  # disabled
define_text_object_6 = DefineTextObject(Text=round_9.Nearest, Plane=pt_3, DimensionStyle=value_list_5, OutputType="Text")  # disabled
define_object_attributes_10 = DefineObjectAttributes(Layer=concat_13)  # disabled
group_10 = Group(Objects=define_text_object_6)  # disabled
bake_objects_10 = BakeObjects(Geometry=group_10, Attributes=define_object_attributes_10, Bake=and_7)  # disabled
bake_modify_layer_6 = BakeModifyLayer(Layer=concat_13, Bake=and_7)  # disabled

panel_88 = Panel("::Contour")  # disabled
concat_14 = Concatenate(FragmentA=panel_68, FragmentB=panel_88)  # disabled
define_object_attributes_11 = DefineObjectAttributes(Layer=concat_14)  # disabled
bake_objects_11 = BakeObjects(Geometry=group, Attributes=define_object_attributes_11, Bake=and_9)  # disabled

panel_89 = Panel("::Contour")  # disabled
concat_15 = Concatenate(FragmentA=panel_71, FragmentB=panel_89)  # disabled
define_object_attributes_12 = DefineObjectAttributes(Layer=concat_15)  # disabled
bake_objects_12 = BakeObjects(Geometry=group_3, Attributes=define_object_attributes_12, Bake=and_6)  # disabled

panel_90 = Panel("::Legend")  # disabled
concat_16 = Concatenate(FragmentA=panel_67, FragmentB=panel_90)  # disabled
define_object_attributes_13 = DefineObjectAttributes(Layer=concat_16)  # disabled
bake_objects_13 = BakeObjects(Geometry=data_4, Attributes=define_object_attributes_13, Bake=False)  # disabled

value_list_7 = ValueList({"Default", "Default 01"}, selected="Default 01")  # disabled
panel_91 = Panel("::Area")  # disabled

panel_92 = Panel("::Legend")  # disabled
concat_17 = Concatenate(FragmentA=panel_68, FragmentB=panel_92)  # disabled
define_object_attributes_14 = DefineObjectAttributes(Layer=concat_17)  # disabled
bake_objects_14 = BakeObjects(Geometry=data_11, Attributes=define_object_attributes_14, Bake=and_9)  # disabled

# ---- group: Run Me!
panel_93 = Panel("SimSurf")  # disabled
falsestart_2 = Ladybug_FalseStartToggle(False)  # disabled

# ----
# Run Radiation Study
simple_yes_no_2 = SimpleYesNo(bool=list_4, Local=analysisperiod_2.hoys, Global=analysisperiod.hoys)  # -> out, flatten(a); inputs bool: Boolean, Local: list, Global: list; disabled; same code as simple_yes_no
flatten_2 = FlattenTree(Tree=simple_yes_no_2.a, Path="{0}")  # disabled
norm_rad = Data(importepw.direct_normal_rad)  # disabled
list_7 = ValueList({"False": 0, "True": 1}, selected="False")  # disabled
diff_rad = Data(importepw.diffuse_horizontal_rad)  # disabled
skymatrix = LBCumulativeSkyMatrix(north=unit, location=importloc, direct_rad=norm_rad, diffuse_rad=diff_rad, hoys=flatten_2, high_density=list_7)  # -> report, sky_mtx; disabled; plug-in component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
cluster_13 = Cluster_3(B=panel_93)  # -> T, G; disabled
panel_94 = Panel("10mm")  # disabled
panel_95 = Panel("10000mm")  # disabled
geo = Geometry(cluster_13.T)  # disabled
sort_brep = SortDuplicateBreps(Breps=cluster_13.G)  # -> UniqueBreps, Indices; disabled
sort_brep_2 = SortDuplicateBreps(Breps=geo)  # -> UniqueBreps, Indices; disabled
docunits_4 = ConvertToDocumentUnits(ValueString=panel_94)  # disabled
docunits_5 = ConvertToDocumentUnits(ValueString=panel_95)  # disabled
incidentradiation = LBIncidentRadiation(
    sky_mtx=skymatrix.sky_mtx,
    geometry=flatten(sort_brep_2.UniqueBreps),
    context=flatten(sort_brep.UniqueBreps),
    grid_size=docunits_5,
    offset_dist=docunits_4,
    parallel=falsestart_2,
    run=falsestart_2)  # -> report, points, results, total, mesh, legend, title, int_mtx; disabled; plug-in component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

lng_6 = ListLength(List=pt)  # disabled
round_10 = Round(Number=room_area_m2_3)  # -> Nearest, Floor, Ceiling; disabled
panel_96 = Panel("3")  # disabled
division_10 = Division(A=lng_6, B=panel_96)  # disabled
panel_97 = Panel("m2")  # disabled
clean_6 = CleanTree(RemoveNulls=True, RemoveInvalid=True, RemoveEmpty=True, Tree=round_10.Nearest)  # disabled
round_11 = Round(Number=division_10)  # -> Nearest, Floor, Ceiling; disabled
concat_18 = Concatenate(FragmentA=panel_67, FragmentB=panel_91)  # disabled
item_5 = ListItem(List=pt, Index=round_11.Nearest, Wrap=True)  # disabled
concat_19 = Concatenate(FragmentA=clean_6, FragmentB=panel_97)  # disabled
define_object_attributes_15 = DefineObjectAttributes(Layer=concat_18)  # disabled
define_text_object_7 = DefineTextObject(Text=concat_19, Plane=item_5, DimensionStyle=value_list_7, OutputType="Text")  # disabled
group_11 = Group(Objects=define_text_object_7)  # disabled
bake_modify_layer_7 = BakeModifyLayer(Layer=concat_18, Bake=and_4)  # disabled
bake_objects_15 = BakeObjects(Geometry=group_11, Attributes=define_object_attributes_15, Bake=and_4)  # disabled

panel_98 = Panel("::Legend")  # disabled
concat_20 = Concatenate(FragmentA=panel_71, FragmentB=panel_98)  # disabled
define_object_attributes_16 = DefineObjectAttributes(Layer=concat_20)  # disabled
bake_objects_16 = BakeObjects(Geometry=data_10, Attributes=define_object_attributes_16, Bake=False)  # disabled

value_list_8 = ValueList({"Default", "Default 01"}, selected="Default 01")  # disabled
panel_99 = Panel("::Area")  # disabled

value_list_9 = ValueList({"Default", "Default 01"}, selected="Default 01")  # disabled
panel_100 = Panel("::Area")  # disabled

lng_7 = ListLength(List=pt_2)  # disabled
round_12 = Round(Number=room_area_m2)  # -> Nearest, Floor, Ceiling; disabled
panel_101 = Panel("3")  # disabled
division_11 = Division(A=lng_7, B=panel_101)  # disabled
panel_102 = Panel("m2")  # disabled
clean_7 = CleanTree(RemoveNulls=True, RemoveInvalid=True, RemoveEmpty=True, Tree=round_12.Nearest)  # disabled
round_13 = Round(Number=division_11)  # -> Nearest, Floor, Ceiling; disabled
concat_21 = Concatenate(FragmentA=panel_68, FragmentB=panel_99)  # disabled
item_6 = ListItem(List=pt_2, Index=round_13.Nearest, Wrap=True)  # disabled
concat_22 = Concatenate(FragmentA=clean_7, FragmentB=panel_102)  # disabled
define_text_object_8 = DefineTextObject(Text=concat_22, Plane=item_6, DimensionStyle=value_list_8, OutputType="Text")  # disabled
define_object_attributes_17 = DefineObjectAttributes(Layer=concat_21)  # disabled
group_12 = Group(Objects=define_text_object_8)  # disabled
bake_modify_layer_8 = BakeModifyLayer(Layer=concat_21, Bake=and_8)  # disabled
bake_objects_17 = BakeObjects(Geometry=group_12, Attributes=define_object_attributes_17, Bake=and_8)  # disabled

lng_8 = ListLength(List=pt_3)  # disabled
round_14 = Round(Number=room_area_m2_2)  # -> Nearest, Floor, Ceiling; disabled
panel_103 = Panel("3")  # disabled
division_12 = Division(A=lng_8, B=panel_103)  # disabled
panel_104 = Panel("m2")  # disabled
clean_8 = CleanTree(RemoveNulls=True, RemoveInvalid=True, RemoveEmpty=True, Tree=round_14.Nearest)  # disabled
round_15 = Round(Number=division_12)  # -> Nearest, Floor, Ceiling; disabled
concat_23 = Concatenate(FragmentA=panel_71, FragmentB=panel_100)  # disabled
item_7 = ListItem(List=pt_3, Index=round_15.Nearest, Wrap=True)  # disabled
concat_24 = Concatenate(FragmentA=clean_8, FragmentB=panel_104)  # disabled
define_object_attributes_18 = DefineObjectAttributes(Layer=concat_23)  # disabled
define_text_object_9 = DefineTextObject(Text=concat_24, Plane=item_7, DimensionStyle=value_list_9, OutputType="Text")  # disabled
group_13 = Group(Objects=define_text_object_9)  # disabled
bake_modify_layer_9 = BakeModifyLayer(Layer=concat_23, Bake=and_7)  # disabled
bake_objects_18 = BakeObjects(Geometry=group_13, Attributes=define_object_attributes_18, Bake=and_7)  # disabled
toggle_33 = FalseStartToggle(False)
# Remapping Values
# Remapping min values
# Remapping max values
# Trim Surface
# Genererer konturkurver (Flat)
# RetningsVektorer
# Get boundary vertices
# Make Surface
# Genererer konturkurver (Grafted)
# Scale results to z-value
# Result "Landscape"
# Max/Min
hideshow_15 = HideShowObjectPreview(Visible=toggle_33)

# ----
# Mesh
panel_105 = Panel("01_daylight_Results::Radiation")  # disabled
toggle_34 = FalseStartToggle(False)  # disabled
panel_106 = Panel("Sun Mesh")  # disabled
onoff_12 = EnableDisableObject(Enabled=toggle_34)  # disabled
layers_2 = CreateModifyLayers(LayerName=panel_105, DeleteLayer=False, enableFullPath=True)  # -> LayerNames, LayerFullPath; disabled
swatch_7 = ColourSwatch(SwatchColor=RGB(0, 0, 0))  # disabled
createatts_2 = CreateAttributes(Name=panel_106, LayerName=layers_2.LayerFullPath, Color=swatch_7, enableFullPath=True)  # disabled
bake_2 = BakeObject(ObjectAttributes=createatts_2, Bake=toggle_34)  # disabled

# ----
# Capture Views
panel_107 = Panel("\02. Scripts")
mappenavn = Panel("05. ViewCaptures")
analysetyper = Panel("""Sollys
Daylight Factor
Daylight Autonomy
UDI
Window""")
relpath = RelativePath(Path=mappenavn)
rep_3 = ReplaceText(Text=relpath, Find=panel_107, RecursiveReplace=False)
panel_108 = Panel(rep_3)
imageheight = Panel("800")
view_width = Panel("1200")
viewtype = Panel("Rendered")
falsestart_3 = Ladybug_FalseStartToggle(True)
and_10 = GateAnd(B=falsestart_3)
path_name = Panel(panel_33)

viewn_name = Panel("""nw
ne
sw
se
Perspective
Top""")
vælg_analysetype = ItemSelector(analysetyper, {"Sollys", "Daylight Factor", "Daylight Autonomy", "UDI", "Window"}, selected="Daylight Autonomy")
concat_25 = Concatenate(FragmentA=vælg_analysetype, FragmentC=" scen2   ", FragmentB=item_selector)

item_selector_2 = ItemSelector(viewn_name, {"nw", "ne", "sw", "se", "Perspective", "Top"}, selected="Perspective")

mindex = MemberIndex(Set=analysetyper, Member=vælg_analysetype)  # -> expr("x+1", Index), Count
concat_26 = Concatenate(FragmentA=panel_108, FragmentB="\0", FragmentC=mindex.Index, FragmentD=".", FragmentE=vælg_analysetype)
captureview = Ladybug_CaptureView(
    fileName="Model3d",
    folder=panel_33,
    viewNames=item_selector_2,
    imageWidth=view_width,
    imageHeight=imageheight,
    displayMode=viewtype,
    capture=falsestart_3)  # -> Output; plug-in component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
viewer = Ladybug_ImageViewer(ImagePath_=captureview, _scale_="1", DisableClickable=False, SaveImgWithCoords=False, scale=1)  # -> ImagePath, Colors, GIF
panel_109 = Panel(viewer.ImagePath)

filename_2 = Panel(concat_25)

# ----
# Visualization
lng_9 = ListLength(List=sunpath.hoys)
lng_10 = ListLength(List=sunpath.hoys)  # -> flatten(Length)
panel_110 = Panel(lng_10)

hours = Slider(3, range=0..10)
list_8 = ValueList({"Shadow Study Layout": 0, "Sun Study Layout": 1}, selected="Sun Study Layout")
eval_2 = Evaluate(F="(y/x)*100", x=lng_9, y=hours)
panel_111 = Panel(eval_2)

cluster_14 = Cluster_4(B=list_8, D=panel_110)
cluster_15 = Cluster_6(A_3=name_of_project, A_2=lng_9, A=panel_111, M=directsunhours.mesh, B=directsunhours.results)
panel_112 = Panel(cluster_15)

list_length = ListLength(List=cluster_14)

legendpar_4 = LBLegendParameters(min="0", max=panel_110, seg_count=list_length, colors=cluster_14, continuous_leg=Toggle(False), num_decimals="0")  # -> leg_par; plug-in component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
heatmap_4 = LBSpatialHeatmap(
    values=directsunhours.results,
    mesh=directsunhours.mesh,
    legend_par=legendpar_4,
    legend_title="Dagslystimer ved jævndøgn",
    global_title=panel_112)  # -> mesh, legend, title, colors, legend_par; plug-in component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
data_12 = Data([heatmap_4.legend, heatmap_4.title])  # disabled
col = Colour(heatmap_4.colors)  # disabled
mesh_4 = Mesh(heatmap_4.mesh)  # disabled

# ==== cluster GRIDDSEN17037
brep = ClusterInput()
brep_2 = Brep(brep)
crv = Curve(brep)
null = NullItem(Item=brep_2)  # -> NullFlags, InvalidFlags, Description
boundary = BoundarySurfaces(Edges=crv)
and = GateAnd(A=null.NullFlags, B=null.InvalidFlags)
cull = CullPattern(List=brep_2, CullPattern=invert(and))
cull_2 = CullPattern(List=boundary, CullPattern=and)
brep_3 = Brep([cull_2, cull])
dim = Dimensions(Surface=brep_3)  # -> UDimension, VDimension
min = Minimum(A=dim.UDimension, B=dim.VDimension)
max = Maximum(A=dim.UDimension, B=dim.VDimension)
larger = LargerThan(FirstNumber=max, SecondNumber=Slider(500, range=0..1000))  # -> LargerThan, OrEqualTo
xor = GateXor(A=Toggle(False), B=larger.LargerThan)
units = LBUnitConverter(values=min, from_u="mm", to_u="m")  # -> all_u, values; plug-in component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
units_2 = LBUnitConverter(values=max, from_u="mm", to_u="m")  # -> all_u, values; plug-in component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
cull_3 = CullPattern(List=max, CullPattern=invert(xor))
cull_4 = CullPattern(List=units_2.values, CullPattern=xor)
eval = Evaluate(F="0.2*5^log10(x)", x=units.values)
panel = Panel([cull_4, cull_3])
python = GhPythonScript(x=eval)  # -> out, a
# ---------- python: Python ----------
__author__ = "ibc"
__version__ = "2020.10.07"

import rhinoscriptsyntax as rs
import math

if x < 1000:
    a="m"
else:
    a="mm"
# ---------- end python ----------
concat = Concatenate(FragmentA=eval, FragmentB=python.a)
panel_2 = Panel(concat)
clean = CleanTree(RemoveNulls=True, RemoveInvalid=True, RemoveEmpty=True, Tree=panel)
eval_2 = Evaluate(F="0.2*5^log10(x)", x=clean)
python_2 = GhPythonScript(x=eval_2)  # -> out, a; same code as python
concat_2 = Concatenate(FragmentA=eval_2, FragmentB=python_2.a)
docunits = ConvertToDocumentUnits(ValueString=[concat_2, "500mm"])  # -> flatten(ValueInDocumentUnits)
panel_3 = Panel(docunits)
panel_4 = ClusterOutput(panel_3)

# ==== cluster Cluster
x = ClusterInput()
pt = ConstructPoint(XCoordinate=0, YCoordinate=0, ZCoordinate=0)
number_slider = Slider(50, range=0..100)
neg = Negative(Value=x)
circle = CircleCNR(Center=pt, Normal=Vector(0, 0, 1), Radius=1)
pt_2 = ClusterOutput(pt)
divide = DivideCurve(Curve=circle, Count=Slider(3600, range=0..10000), Kinks=False)  # -> Points, Tangents, Parameters
eval = Evaluate(F="x*10+900", x=neg)
item = ListItem(List=divide.Points, Index=eval, Wrap=True)
docunits = ConvertToDocumentUnits(ValueString="50m")
vec2pt = Vector2Pt(PointA=pt, PointB=item, Unitize=False)  # -> Vector, Length
amp = Amplitude(Vector=vec2pt.Vector, Amplitude=docunits)
V = ClusterOutput(amp)

# ==== cluster ForExplanationDobubleClickMe
# • The illuminance is less than 100 lux, i.e. UDI ‘fell-short’ (or UDI-f).
# • The illuminance is greater than 100 lux and less than 500 lux, i.e. UDI supplementary (or UDI-s).
# • The illuminance is greater than 500 lux and less than 2,500 lux, i.e. UDI autonomous
# (or UDI-a).
# • The illuminance is greater than 100 lux and less than 2,500 lux, i.e. UDI combined
# (or UDI-c).
# • The illuminance is greater than 2,500 lux, i.e. UDI exceeded (or UDI-e).
panel = Panel("""UDI-f
UDI-s
UDI-a
UDI-c
UDI-e""")

# ==== cluster Cluster_2
B = ClusterInput()
C = ClusterInput()
panel = Panel("""brep
surface
extrusion
mesh""")
concat = Concatenate(FragmentA="0_materials::", FragmentB=B, FragmentD="_0.", FragmentC=graft(C))
panel_2 = Panel(concat)
txt = Text(concat)
panel_3 = Panel(txt)
dpipeline = DynamicGeometryPipeline(
    LayerFilter=graft(concat),
    TypeFilter=panel,
    NameFilter="*",
    GroupByLayer=False,
    GroupByType=False,
    IncludeHidden=True,
    IncludeLocked=True,
    enableFullPath=True,
    listenToAttributes=True)
panel_4 = Panel(""":
_""")
split = TextSplit(Text=panel_3, Separators=panel_4)
filterlay = FilterByLayer(Geometry=dpipeline, Layer=concat, OnlyVisible=True)
item = ListItem(List=split, Index=0, Wrap=True)  # -> Item2, Item1, Item, Item1_2
panel_5 = Panel(item.Item1)
panel_6 = Panel(item.Item2)
txt_2 = Text(panel_6)
txt_3 = Text(panel_5)
clean = CleanTree(RemoveNulls=True, RemoveInvalid=True, RemoveEmpty=True, Tree=filterlay)
txt_4 = ClusterOutput(txt_2)
txt_5 = ClusterOutput(txt_3)
T = ClusterOutput(clean)

# ==== cluster Cluster_3
B = ClusterInput()
B_2 = ClusterInput()
panel = Panel("""brep
surface
extrusion
mesh""")
concat = Concatenate(FragmentA="0_daylight::", FragmentB=B)
panel_2 = Panel(concat)
concat_2 = Concatenate(FragmentA="0_daylight::", FragmentB=B_2)
panel_3 = Panel(concat_2)
dpipeline = DynamicGeometryPipeline(
    LayerFilter=graft(concat_2),
    TypeFilter=panel,
    NameFilter="*",
    GroupByLayer=False,
    GroupByType=False,
    IncludeHidden=True,
    IncludeLocked=True,
    enableFullPath=True,
    listenToAttributes=True)  # -> flatten(GeometryOut)
dpipeline_2 = DynamicGeometryPipeline(
    LayerFilter=graft(concat),
    TypeFilter=panel,
    NameFilter="*",
    GroupByLayer=False,
    GroupByType=False,
    IncludeHidden=True,
    IncludeLocked=True,
    enableFullPath=True,
    listenToAttributes=True)
filterlay = FilterByLayer(Geometry=dpipeline_2, Layer=concat, OnlyVisible=True)
panel_4 = Panel(dpipeline)
debrep = DeconstructBrep(Brep=filterlay)  # -> Faces, Edges, Vertices
filterlay_2 = FilterByLayer(Geometry=dpipeline, Layer=concat_2, OnlyVisible=True)
clean = CleanTree(RemoveNulls=True, RemoveInvalid=True, RemoveEmpty=True, Tree=debrep.Faces)
T = ClusterOutput(clean)
G = ClusterOutput(filterlay_2)

# ==== cluster Cluster_4
D = ClusterInput()
range = Range(Domain=D, Steps=D)
panel = Panel(D)
bounds = Bounds(Numbers=range)
deconstruct_domain = DeconstructDomain(Domain=bounds)  # -> Start, End
B = ClusterInput()
gradient = Gradient(
    LowerLimit=deconstruct_domain.Start,
    UpperLimit=deconstruct_domain.End,
    Parameter=range,
    stops=[0: RGB(0, 0, 0), 1: RGB(255, 255, 255)])
gradient_2 = Gradient(
    LowerLimit=deconstruct_domain.Start,
    UpperLimit=deconstruct_domain.End,
    Parameter=range,
    stops=[0: RGB(0, 0, 255), 0.5: RGB(255, 0, 0), 1: RGB(255, 255, 0)])
xor = GateXor(A=Toggle(False), B=B)
cull = CullPattern(List=gradient, CullPattern=invert(xor))
cull_2 = CullPattern(List=gradient_2, CullPattern=xor)
panel_2 = Panel(gradient_2)
data = Data([cull, cull_2])
data_2 = ClusterOutput(data)
panel_3 = Panel(data)

# ==== cluster Cluster_6
number_slider = Slider(12, range=0..100)
A = ClusterInput()
panel = Panel(A)
A_2 = ClusterInput()

division = Division(A=A, B="100")
multiplication = Multiplication(A=A_2, B=division)
panel_2 = Panel(multiplication)
round = Round(Number=panel_2)  # -> Nearest, Floor, Ceiling
panel_3 = Panel(round.Nearest)

data = Data(A_2)
panel_4 = Panel(data)
B = ClusterInput()
M = ClusterInput()
panel_5 = Panel(B)
panel_6 = Panel(M)

# ----
# Udregner det vertikale areal, der overholder det valgte solskinstime antal.
larger = LargerThan(FirstNumber=round.Nearest, SecondNumber=flatten(B))  # -> LargerThan, OrEqualTo
cullf = CullFaces(Mesh=M, Pattern=larger.LargerThan)
facen = FaceNormals(Mesh=cullf)  # -> Centers, Normals
devec = DeconstructVector(Vector=facen.Normals)  # -> XComponent, YComponent, ZComponent
round_2 = Round(Number=devec.ZComponent)  # -> Nearest, Floor, Ceiling
equals = Equality(FirstNumber=round_2.Nearest, SecondNumber=Slider(0, range=0..100))  # -> Equality, Inequality
cullf_2 = CullFaces(Mesh=cullf, Pattern=equals.Inequality)
area = Area(Geometry=cullf_2)  # -> Area, Centroid
panel_7 = Panel(area.Area)

# ----
# Udregner totale vertikale areal af klimaskærm.
facen_2 = FaceNormals(Mesh=M)  # -> Centers, Normals
devec_2 = DeconstructVector(Vector=facen_2.Normals)  # -> XComponent, YComponent, ZComponent
round_3 = Round(Number=devec_2.ZComponent)  # -> Nearest, Floor, Ceiling
equals_2 = Equality(FirstNumber=round_3.Nearest, SecondNumber=Slider(0, range=0..100))  # -> Equality, Inequality
cullf_3 = CullFaces(Mesh=flatten(M), Pattern=flatten(equals_2.Inequality))
area_2 = Area(Geometry=cullf_3)  # -> Area, Centroid
panel_8 = Panel(area_2.Area)

A_3 = ClusterInput()
area_3 = Area(Geometry=M)  # -> Area, Centroid
panel_9 = Panel(area_3.Area)

# ----
# % del af facade, som opfylder
# solskinstimeantallet på facade
cluster = Cluster_5(A=panel_7, B=panel_8)
panel_10 = Panel(cluster)
panel_11 = Panel(panel_3)
panel_12 = Panel("%.")
concat = Concatenate(
    FragmentA=A_3,
    FragmentB=":",
    FragmentC=" ",
    FragmentD=panel_10,
    FragmentE="% of the facade recieves ",
    FragmentF=" ",
    FragmentG=panel_11,
    FragmentH=" ",
    FragmentL="or more",
    FragmentM=" ",
    FragmentI="hours of direct sunlight",
    FragmentJ=" ")

panel_13 = Panel(concat)
R = ClusterOutput(concat)

# ==== cluster Cluster_7
L = ClusterInput()
L_2 = ClusterInput()

# ----
# Model Unit Scaling
A = ClusterInput()
smaller = SmallerThan(FirstNumber=A, SecondNumber="850")  # -> SmallerThan, OrEqualTo
xor = GateXor(A=Toggle(False), B=smaller.OrEqualTo)
cull = CullPattern(List=L, CullPattern=invert(xor))
cull_2 = CullPattern(List=L_2, CullPattern=xor)

panel = Panel(A)
panel_2 = Panel([cull, cull_2])
L_3 = ClusterOutput(cull)
L_4 = ClusterOutput(cull_2)

# ==== cluster AnalysisGrid: Creates analysis grid for daylight simulations
falsestart = Ladybug_FalseStartToggle(False)
B = ClusterInput()
brep = ClusterInput()
panel = Panel(brep)
A = ClusterInput()
referencehøjde = Panel(A)
D = ClusterInput()
dist_from_base = Panel(D)
B_2 = ClusterInput()
dist_between_gridpoints = Panel(B_2)
xor = GateXor(A=falsestart, B=B)

# ----
# Curve or Brep ?
crv = Curve(brep)
brep_2 = Brep(brep)
null = NullItem(Item=brep_2)  # -> NullFlags, InvalidFlags, Description
boundary = BoundarySurfaces(Edges=crv)
and = GateAnd(A=null.NullFlags, B=null.InvalidFlags)
cull = CullPattern(List=brep_2, CullPattern=invert(and))
cull_2 = CullPattern(List=boundary, CullPattern=and)
brep_3 = Brep([cull_2, cull])

# ----
# Remove small areas < 5m2
panel_2 = Panel("2236mm")
panel_3 = Panel("1000mm")
docunits = ConvertToDocumentUnits(ValueString=panel_2)
multiplication = Multiplication(A=docunits, B=docunits)
area = Area(Geometry=brep_3)  # -> Area, Centroid
larger = LargerThan(FirstNumber=area.Area, SecondNumber=multiplication)  # -> LargerThan, OrEqualTo
panel_4 = Panel(larger.LargerThan)
cull_3 = CullPattern(List=brep_3, CullPattern=larger.LargerThan)

# ----
# Normals Controls
panel_5 = Panel("{0.5, 0.5, 0}")
evalsrf = EvaluateSurface(Surface=reparameterize(cull_3), Point=panel_5)  # -> Point, Normal, UDirection, VDirection, Frame
neg = Negative(Value=evalsrf.Normal)
untrim = Untrim(Surface=cull_3)
cull_4 = CullPattern(List=neg, CullPattern=invert(xor))
cull_5 = CullPattern(List=evalsrf.Normal, CullPattern=xor)
docunits_2 = ConvertToDocumentUnits(ValueString="-5000mm")
docunits_3 = ConvertToDocumentUnits(ValueString="5000mm")
area_2 = Area(Geometry=untrim)  # -> Area, Centroid
data = Data([cull_5, cull_4])
concat = Concatenate(FragmentA=docunits_2, FragmentB=" to ", FragmentC=docunits_3)
pl = PlaneNormal(Origin=area_2.Centroid, ZAxis=data)
rectangle = Rectangle(Plane=pl, XSize=concat, YSize=concat, Radius=0)  # -> Rectangle, Length
planesrf = PlaneSurface(Plane=pl, XSize=Domain(-10, 10), YSize=Domain(-10, 10))
boundary_2 = BoundarySurfaces(Edges=rectangle.Rectangle)

# ----
# Flipping/Moving Geometry
flip = Flip(Surface=cull_3, Guide=planesrf)  # -> Surface, Result
debrep = DeconstructBrep(Brep=boundary_2)  # -> Faces, Edges, Vertices
vec = Vector(pl)
amp = Amplitude(Vector=vec, Amplitude=A)
pline = PolyLine(Vertices=debrep.Vertices, Closed=True)
move = Move(Geometry=flip.Surface, Motion=amp)  # -> Geometry, Transform
debrep_2 = DeconstructBrep(Brep=move.Geometry)  # -> Faces, Edges, Vertices
flip_2 = FlipCurve(Curve=pline)  # -> Curve, Flag
join_curves = JoinCurves(Curves=debrep_2.Edges, Preserve=False)
flip_3 = FlipCurve(Curve=join_curves, Guide=flip_2.Curve)  # -> Curve, Flag

evalsrf_2 = EvaluateSurface(Surface=reparameterize(move.Geometry), Point="{0.5, 0.5, 0}")  # -> Point, Normal, UDirection, VDirection, Frame
docunits_4 = ConvertToDocumentUnits(ValueString="5000mm")
amp_2 = Amplitude(Vector=evalsrf_2.Normal, Amplitude=docunits_4)
vdisex = VectorDisplayEx(Point=evalsrf_2.Point, Vector=amp_2, Colour=RGB(0, 0, 0), Width=2)

prudecrv = PrudeCurve(Curve=flip_3.Curve, Length=0.1595272236, BlendType=0, Bulge=0.5)  # -> Prude, R
offcrv = OffsetCurve(Curve=flip_3.Curve, Plane=pl, Distance=D, BothSides=False, Kinks=0, CapType=1)
boundary_3 = BoundarySurfaces(Edges=offcrv)

# ----
# Remove small areas < 5m2
panel_6 = Panel("100mm")
area_3 = Area(Geometry=boundary_3)  # -> Area, Centroid
docunits_5 = ConvertToDocumentUnits(ValueString=panel_6)
multiplication_2 = Multiplication(A=docunits_5, B=docunits_5)
larger_2 = LargerThan(FirstNumber=area_3.Area, SecondNumber=multiplication_2)  # -> LargerThan, OrEqualTo
cull_6 = CullPattern(List=boundary_3, CullPattern=larger_2.LargerThan)
panel_7 = Panel(larger_2.LargerThan)
clean_tree = CleanTree(RemoveNulls=True, RemoveInvalid=True, RemoveEmpty=True, Tree=cull_6)

# ----
# Untrimming/Retrimmung and subdividing surface
untrim_2 = Untrim(Surface=clean_tree)
dim = Dimensions(Surface=untrim_2)  # -> UDimension, VDimension
division = Division(A=dim.UDimension, B=B_2)
division_2 = Division(A=dim.VDimension, B=B_2)
round = Round(Number=division_2)  # -> Nearest, Floor, Ceiling
round_2 = Round(Number=division)  # -> Nearest, Floor, Ceiling
graft = GraftTree(Tree=untrim_2, IncludeEmptyLists=True, IncludeNullItems=True)
divide = DivideDomain²(Domain=untrim_2, UCount=round_2.Nearest, VCount=round.Nearest)
subsrf = Isotrim(Surface=graft, Domain=divide)  # -> simplify(Surface)
graft_2 = GraftTree(Tree=clean_tree, IncludeEmptyLists=True, IncludeNullItems=True)
flip_4 = Flip(Surface=simplify(subsrf), Guide=graft(flip.Surface))  # -> Surface, Result
evalsrf_3 = EvaluateSurface(Surface=reparameterize(flip_4.Surface), Point="{0.5, 0.5, 0}")  # -> Point, Normal, UDirection, VDirection, Frame
incurve = PointInCurve(Point=evalsrf_3.Point, Curve=graft_2)  # -> Relationship, Point

# ---- group: surfaces for coloring!
cull_7 = CullPattern(List=flip_4.Surface, CullPattern=incurve.Relationship)

# ----
# Final Sorting
cull_8 = CullPattern(List=evalsrf_3.Point, CullPattern=incurve.Relationship)
cull_9 = CullPattern(List=evalsrf_3.Normal, CullPattern=incurve.Relationship)
number_slider = Slider(1, range=0..1)
wires = BrepWireframe(Brep=cull_7, Density=-1)
area_4 = Area(Geometry=cull_7)  # -> Area, Centroid
docunits_6 = ConvertToDocumentUnits(ValueString="5000mm")
amp_3 = Amplitude(Vector=cull_9, Amplitude=docunits_6)
mesh_uv = MeshSurface(Surface=cull_7, UCount=number_slider, VCount=number_slider, Overhang=True, Equalize=False)
mjoin = MeshJoin(Meshes=mesh_uv)
vdisex_2 = VectorDisplayEx(Point=cull_8, Vector=amp_3, Colour=RGB(0, 0, 0), Width=2)

docunits_7 = ConvertToDocumentUnits(ValueString="5000mm")
amp_4 = Amplitude(Vector=evalsrf_3.Normal, Amplitude=docunits_7)
vdisex_3 = VectorDisplayEx(Point=evalsrf_3.Point, Vector=amp_4, Colour=RGB(0, 0, 0), Width=2)

L = ClusterOutput(cull_8)
L_2 = ClusterOutput(cull_9)
A_2 = ClusterOutput(area_4.Area)
L_3 = ClusterOutput(cull_7)
M = ClusterOutput(mjoin)

# ==== cluster TopographyV10: Creates topographic surfaces from assigned point values along with height curves

# ----
# Analysis surface(s)
srf = ClusterInput()
srf_2 = Surface(srf)
join = BrepJoin(Breps=srf_2)  # -> Breps, Closed
fmerge = MergeFaces(Brep=join.Breps)  # -> Breps, Before, After
flip = Flip(Surface=fmerge.Breps)  # -> Surface, Result

falsestart = Ladybug_FalseStartToggle(False)
falsestart_2 = Ladybug_FalseStartToggle(False)
wiredisplay = ControlWireDisplay(WireDisplay=Slider(0, range=0..2))
hideshow = HideShowObjectPreview(Visible=falsestart)
onoff = EnableDisableObject(Enabled=falsestart_2)

# ----
# Flip Normals ?
falsestart_3 = Ladybug_FalseStartToggle(False)
bool = Boolean(True)
xor = GateXor(A=falsestart_3, B=bool)

B = ClusterInput()

# ----
# Results
results = ClusterInput()
results_2 = Number(simplify(results))

# ----
# Analysis points
pt = ClusterInput()
pt_2 = Point(pt)

static_dynamic = Panel(B)

# ----
# Normal Control
panel = Panel("{0.5,0.5,0}")
evalsrf = EvaluateSurface(Surface=reparameterize(flip.Surface), Point=panel)  # -> Point, Normal, UDirection, VDirection, Frame
neg = Negative(Value=evalsrf.Normal)
cull = CullPattern(List=neg, CullPattern=invert(xor))
cull_2 = CullPattern(List=evalsrf.Normal, CullPattern=xor)
docunits = ConvertToDocumentUnits(ValueString="1000mm")
data = Data([cull_2, cull])
amp = Amplitude(Vector=evalsrf.Normal, Amplitude=docunits)
vdisex = VectorDisplayEx(Point=pt_2, Vector=amp, Colour=RGB(0, 0, 0), Width=2)

# ----
# Create Plane Orientation
panel_2 = Panel("5000mm")
untrim = Untrim(Surface=flip.Surface)
area = Area(Geometry=untrim)  # -> Area, Centroid
docunits_2 = ConvertToDocumentUnits(ValueString="-5000mm")
docunits_3 = ConvertToDocumentUnits(ValueString=panel_2)
concat = Concatenate(FragmentA=docunits_2, FragmentB=" to ", FragmentC=docunits_3)
pl = PlaneNormal(Origin=area.Centroid, ZAxis=data)
planesrf = PlaneSurface(Plane=pl, XSize=Domain(-10, 10), YSize=Domain(-10, 10))
rectangle = Rectangle(Plane=pl, XSize=concat, YSize=concat, Radius=0)  # -> Rectangle, Length

debrep = DeconstructBrep(Brep=fmerge.Breps)  # -> simplify(Faces), Edges, simplify(Vertices)
crv = Curve(rectangle.Rectangle)
join_2 = JoinCurves(Curves=debrep.Edges, Preserve=True)  # -> simplify(Curves)
list = ItemSelector(crv)
crv_2 = Curve(join_2)
flip_2 = FlipCurve(Curve=crv_2, Guide=list)  # -> Curve, Flag

results_3 = Panel(results_2)
bnd = Bounds(Numbers=results_3)
result_domain = Panel(bnd)

# ----
# Scaling values to geometric value
panel_3 = Panel("1")
pcent = Percentage(Number=results_2, Percent="1000")
xor_2 = GateXor(A=Toggle(False), B=B)
cull_3 = CullPattern(List=pcent, CullPattern=xor_2)

panel_4 = Panel("""0
100""")
pcent_2 = Percentage(Number="1000", Percent=panel_4)
pcent_3 = Percentage(Number=panel_4, Percent=panel_3)
cull_4 = CullPattern(List=pcent_3, CullPattern=invert(xor_2))
cull_5 = CullPattern(List=pcent_2, CullPattern=xor_2)
panel_5 = Panel([cull_4, cull_5])
clean = CleanTree(RemoveNulls=True, RemoveInvalid=True, RemoveEmpty=True, Tree=panel_5)

pcent_4 = Percentage(Number=results_2, Percent=panel_3)

cull_6 = CullPattern(List=pcent_4, CullPattern=invert(xor_2))
panel_6 = Panel([cull_3, cull_6])
clean_2 = CleanTree(RemoveNulls=True, RemoveInvalid=True, RemoveEmpty=True, Tree=panel_6)

# ----
# Interpolate edges
cps = ClosestPoints(Point=debrep.Vertices, Cloud=pt_2, Count=1)  # -> ClosestPoint, CPIndex, Distance
item = ListItem(List=clean_2, Index=cps.CPIndex, Wrap=True)
amp_2 = Amplitude(Vector=evalsrf.Normal, Amplitude=flatten(item))
move = Move(Geometry=debrep.Vertices, Motion=amp_2)  # -> Geometry, Transform

# ----
# Scale points to result value
amp_3 = Amplitude(Vector=evalsrf.Normal, Amplitude=clean_2)
move_2 = Move(Geometry=pt_2, Motion=amp_3)  # -> Geometry, Transform

# ----
# Make Result Topography
pt_3 = Point(flatten([move_2.Geometry, move.Geometry]))
patch = Patch(Points=pt_3, Spans=Slider(30, range=0..100), Flexibility=Slider(30, range=0..100), Trim=True)

# ---- group: Safetynet #1
# Trim topo to analysis area
project = Project(Curve=flip_2.Curve, Brep=simplify(patch), Direction=data)  # -> simplify(Curve)
srfsplit = SurfaceSplit(Surface=patch, Curves=project)
debrep_2 = DeconstructBrep(Brep=srfsplit)  # -> Faces, Edges, Vertices
join_3 = JoinCurves(Curves=debrep_2.Edges, Preserve=False)
lng = ListLength(List=join_3)
larger = LargerThan(FirstNumber="1", SecondNumber=lng)  # -> LargerThan, OrEqualTo
cull_7 = CullPattern(List=simplify(srfsplit), CullPattern=flatten(larger.OrEqualTo))

# ---- group: SafetyNet#2
area_2 = Area(Geometry=flip.Surface)  # -> Area, Centroid
area_3 = Area(Geometry=cull_7)  # -> Area, Centroid
cp = ClosestPoint(Point=area_2.Centroid, Cloud=area_3.Centroid)  # -> ClosestPoint, CPIndex, Distance
list_2 = ItemSelector(cp.CPIndex)
item_2 = ListItem(List=cull_7, Index=list_2, Wrap=True)

# ----
evalsrf_2 = EvaluateSurface(Surface=reparameterize(item_2), Point="{0.5,0.5,0}")  # -> Point, Normal, UDirection, VDirection, Frame
docunits_4 = ConvertToDocumentUnits(ValueString="200mm")
pt_4 = Point(evalsrf_2.Point)

max_min_result_vector = Panel(panel_5)
bnd_2 = Bounds(Numbers=max_min_result_vector)
max_min_result_vector_domain = Panel(bnd_2)

result_vector = Panel(panel_6)
bnd_3 = Bounds(Numbers=result_vector)
result_vector_domain = Panel(bnd_3)

# ----
# Genererer konturkurver
srf_3 = Surface(item_2)
contour = Contour(Shape=simplify(srf_3), Point=pt_4, Direction=pl, Distance=docunits_4)
debrep_3 = DeconstructBrep(Brep=srf_3)  # -> Faces, Edges, Vertices
join_4 = JoinCurves(Curves=debrep_3.Edges, Preserve=False)  # -> flatten(Curves)
trim = TrimWithRegions(Curve=simplify(contour), Regions=simplify(join_4))  # -> simplify(graft(Inside)), Outside
path_mapper = PathMapper(trim.Inside, source="{A;B;C;D}", target="{A}")
path_mapper_2 = PathMapper(trim.Inside, source="{A;B;C}", target="{A}")
path_mapper_3 = PathMapper(trim.Inside, source="{A;B}", target="{A}")

path_mapper_4 = PathMapper(trim.Inside, source="{A}", target="{0}")
path_mapper_5 = PathMapper(trim.Inside, source="{A}", target="{A}")

crv_3 = Curve(path_mapper_4)
clean_3 = CleanTree(RemoveNulls=True, RemoveInvalid=True, RemoveEmpty=True, Tree=crv_3)
crv_4 = Curve(clean_3)

# ----
# Remapping Values
mesh = MeshBrep(
    Brep=item_2,
    Settings={GridMaxCount=0, GridMinCount=16, JaggedSeams=True, MaxEdgeLength=2000, MinEdgeLength=700, MinTolerance=0, Refine=True, RefineAngle=0, RelativeTolerance=0.65, SimplePlanes=False, Tolerance=0})  # -> simplify(Mesh)
demesh = DeconstructMesh(Mesh=mesh)  # -> Vertices, Faces, Colours, Normals

project_2 = Project(Geometry=demesh.Vertices, Plane=pl)  # -> Geometry, Transform
dist = Distance(PointA=project_2.Geometry, PointB=demesh.Vertices)

mesh_points = Panel(dist)
bnd_4 = Bounds(Numbers=mesh_points)
mesh_points_domain = Panel(bnd_4)

panel_7 = Panel(dist)

remap = RemapNumbers(Value=dist, Source=max_min_result_vector_domain, Target="0 to 100")  # -> Mapped, Clipped
panel_8 = Panel(remap.Clipped)
panel_9 = Panel(remap.Mapped)

remapped_number = Panel(remap.Clipped)
bnd_5 = Bounds(Numbers=remapped_number)
remapped_domain = Panel(bnd_5)

# ----
# Colors sorted for legend
sort = SortList(Keys=remap.Clipped, ValuesA=remap.Clipped)  # -> Keys, ValuesA
panel_10 = Panel(sort.ValuesA)
gradient = Gradient(
    LowerLimit="0",
    UpperLimit="100",
    Parameter=sort.ValuesA,
    stops=[0: RGB(94, 120, 145), 0.38: RGB(167, 209, 82), 0.615: RGB(255, 210, 87), 1: RGB(255, 250, 204)])
gradient_2 = Gradient(
    LowerLimit="0",
    UpperLimit="100",
    Parameter=sort.ValuesA,
    stops=[0: RGB(0, 255, 255), 0.461: RGB(255, 255, 0), 1: RGB(255, 0, 0)])

bnd_6 = Bounds(Numbers=results_2)
dedomain = DeconstructDomain(Domain=bnd_6)  # -> Start, End
smaller = SmallerThan(FirstNumber=dedomain.End, SecondNumber="25")  # -> SmallerThan, OrEqualTo
xor_3 = GateXor(A=Toggle(False), B=smaller.OrEqualTo)
cull_8 = CullPattern(List=gradient_2, CullPattern=invert(xor_3))
cull_9 = CullPattern(List=gradient, CullPattern=xor_3)
data_2 = Data([cull_8, cull_9])

# ----
# IsoCurve and Gradient mesh
panel_11 = Panel("0")
gradient_3 = Gradient(
    LowerLimit=panel_11,
    UpperLimit="100",
    Parameter=remap.Clipped,
    stops=[0: RGB(94, 120, 145), 0.38: RGB(167, 209, 82), 0.615: RGB(255, 210, 87), 1: RGB(255, 250, 204)])
gradient_4 = Gradient(
    LowerLimit=panel_11,
    UpperLimit="100",
    Parameter=remap.Clipped,
    stops=[0: RGB(0, 255, 255), 0.461: RGB(255, 255, 0), 1: RGB(255, 0, 0)])

bnd_7 = Bounds(Numbers=results_2)
dedomain_2 = DeconstructDomain(Domain=bnd_7)  # -> Start, End
smaller_2 = SmallerThan(FirstNumber=dedomain_2.End, SecondNumber="25")  # -> SmallerThan, OrEqualTo
xor_4 = GateXor(A=Toggle(False), B=smaller_2.OrEqualTo)
cull_10 = CullPattern(List=gradient_4, CullPattern=invert(xor_4))
cull_11 = CullPattern(List=gradient_3, CullPattern=xor_4)
data_3 = Data([cull_10, cull_11])
conmesh = ConstructMesh(Vertices=demesh.Vertices, Faces=demesh.Faces, Colours=data_3)  # -> simplify(Mesh)

remapped_numbers = Number(remap.Clipped)
vertices = Point(demesh.Vertices)
crv_5 = Curve(crv_4)
face = MeshFace(demesh.Faces)
pln = Plane(pl)
colors = Data(data_2)
mesh_2 = Mesh(conmesh)
remapped_numbers_2 = ClusterOutput(remapped_numbers)
pln_2 = ClusterOutput(pln)
colors_2 = ClusterOutput(colors)
mesh_3 = ClusterOutput(mesh_2)
crv_6 = ClusterOutput(crv_5)
face_2 = ClusterOutput(face)
vertices_2 = ClusterOutput(vertices)

# ==== cluster TopographyV10_2: Creates topographic surfaces from assigned point values along with height curves

# ----
# Analysis surface(s)
srf = ClusterInput()
srf_2 = Surface(srf)
join = BrepJoin(Breps=srf_2)  # -> Breps, Closed
fmerge = MergeFaces(Brep=join.Breps)  # -> Breps, Before, After
flip = Flip(Surface=fmerge.Breps)  # -> Surface, Result

falsestart = Ladybug_FalseStartToggle(False)
falsestart_2 = Ladybug_FalseStartToggle(False)
wiredisplay = ControlWireDisplay(WireDisplay=Slider(0, range=0..2))
hideshow = HideShowObjectPreview(Visible=falsestart)
onoff = EnableDisableObject(Enabled=falsestart_2)

# ----
# Flip Normals ?
falsestart_3 = Ladybug_FalseStartToggle(False)
bool = Boolean(True)
xor = GateXor(A=falsestart_3, B=bool)

B = ClusterInput()

# ----
# Results
results = ClusterInput()
results_2 = Number(simplify(results))

# ----
# Analysis points
pt = ClusterInput()
pt_2 = Point(pt)

static_dynamic = Panel(B)

# ----
# Normal Control
panel = Panel("{0.5,0.5,0}")
evalsrf = EvaluateSurface(Surface=reparameterize(flip.Surface), Point=panel)  # -> Point, Normal, UDirection, VDirection, Frame
neg = Negative(Value=evalsrf.Normal)
cull = CullPattern(List=neg, CullPattern=invert(xor))
cull_2 = CullPattern(List=evalsrf.Normal, CullPattern=xor)
docunits = ConvertToDocumentUnits(ValueString="1000mm")
data = Data([cull_2, cull])
amp = Amplitude(Vector=evalsrf.Normal, Amplitude=docunits)
vdisex = VectorDisplayEx(Point=pt_2, Vector=amp, Colour=RGB(0, 0, 0), Width=2)

# ----
# Create Plane Orientation
panel_2 = Panel("5000mm")
untrim = Untrim(Surface=flip.Surface)
area = Area(Geometry=untrim)  # -> Area, Centroid
docunits_2 = ConvertToDocumentUnits(ValueString="-5000mm")
docunits_3 = ConvertToDocumentUnits(ValueString=panel_2)
concat = Concatenate(FragmentA=docunits_2, FragmentB=" to ", FragmentC=docunits_3)
pl = PlaneNormal(Origin=area.Centroid, ZAxis=data)
planesrf = PlaneSurface(Plane=pl, XSize=Domain(-10, 10), YSize=Domain(-10, 10))
rectangle = Rectangle(Plane=pl, XSize=concat, YSize=concat, Radius=0)  # -> Rectangle, Length

debrep = DeconstructBrep(Brep=fmerge.Breps)  # -> simplify(Faces), Edges, simplify(Vertices)
crv = Curve(rectangle.Rectangle)
join_2 = JoinCurves(Curves=debrep.Edges, Preserve=True)  # -> simplify(Curves)
list = ItemSelector(crv, {"Polyline Curve"}, selected="Polyline Curve")
crv_2 = Curve(join_2)
flip_2 = FlipCurve(Curve=crv_2, Guide=list)  # -> Curve, Flag

results_3 = Panel(results_2)
bnd = Bounds(Numbers=results_3)
result_domain = Panel(bnd)

# ----
# Scaling values to geometric value
panel_3 = Panel("1")
pcent = Percentage(Number=results_2, Percent="1000")
xor_2 = GateXor(A=Toggle(False), B=B)
cull_3 = CullPattern(List=pcent, CullPattern=xor_2)

panel_4 = Panel("""0
100""")
pcent_2 = Percentage(Number="1000", Percent=panel_4)
pcent_3 = Percentage(Number=panel_4, Percent=panel_3)
cull_4 = CullPattern(List=pcent_3, CullPattern=invert(xor_2))
cull_5 = CullPattern(List=pcent_2, CullPattern=xor_2)
panel_5 = Panel([cull_4, cull_5])
clean = CleanTree(RemoveNulls=True, RemoveInvalid=True, RemoveEmpty=True, Tree=panel_5)

pcent_4 = Percentage(Number=results_2, Percent=panel_3)

cull_6 = CullPattern(List=pcent_4, CullPattern=invert(xor_2))
panel_6 = Panel([cull_3, cull_6])
clean_2 = CleanTree(RemoveNulls=True, RemoveInvalid=True, RemoveEmpty=True, Tree=panel_6)

# ----
# Interpolate edges
cps = ClosestPoints(Point=debrep.Vertices, Cloud=pt_2, Count=1)  # -> ClosestPoint, CPIndex, Distance
item = ListItem(List=clean_2, Index=cps.CPIndex, Wrap=True)
amp_2 = Amplitude(Vector=evalsrf.Normal, Amplitude=flatten(item))
move = Move(Geometry=debrep.Vertices, Motion=amp_2)  # -> Geometry, Transform

# ----
# Scale points to result value
amp_3 = Amplitude(Vector=evalsrf.Normal, Amplitude=clean_2)
move_2 = Move(Geometry=pt_2, Motion=amp_3)  # -> Geometry, Transform

# ----
# Make Result Topography
pt_3 = Point(flatten([move_2.Geometry, move.Geometry]))
patch = Patch(Points=pt_3, Spans=Slider(30, range=0..100), Flexibility=Slider(30, range=0..100), Trim=True)

# ---- group: Safetynet #1
# Trim topo to analysis area
project = Project(Curve=flip_2.Curve, Brep=simplify(patch), Direction=data)  # -> simplify(Curve)
srfsplit = SurfaceSplit(Surface=patch, Curves=project)
debrep_2 = DeconstructBrep(Brep=srfsplit)  # -> Faces, Edges, Vertices
join_3 = JoinCurves(Curves=debrep_2.Edges, Preserve=False)
lng = ListLength(List=join_3)
larger = LargerThan(FirstNumber="1", SecondNumber=lng)  # -> LargerThan, OrEqualTo
cull_7 = CullPattern(List=simplify(srfsplit), CullPattern=flatten(larger.OrEqualTo))

# ---- group: SafetyNet#2
area_2 = Area(Geometry=flip.Surface)  # -> Area, Centroid
area_3 = Area(Geometry=cull_7)  # -> Area, Centroid
cp = ClosestPoint(Point=area_2.Centroid, Cloud=area_3.Centroid)  # -> ClosestPoint, CPIndex, Distance
list_2 = ItemSelector(cp.CPIndex, {"0"}, selected="0")
item_2 = ListItem(List=cull_7, Index=list_2, Wrap=True)

# ----
evalsrf_2 = EvaluateSurface(Surface=reparameterize(item_2), Point="{0.5,0.5,0}")  # -> Point, Normal, UDirection, VDirection, Frame
docunits_4 = ConvertToDocumentUnits(ValueString="200mm")
pt_4 = Point(evalsrf_2.Point)

max_min_result_vector = Panel(panel_5)
bnd_2 = Bounds(Numbers=max_min_result_vector)
max_min_result_vector_domain = Panel(bnd_2)

result_vector = Panel(panel_6)
bnd_3 = Bounds(Numbers=result_vector)
result_vector_domain = Panel(bnd_3)

# ----
# Genererer konturkurver
srf_3 = Surface(item_2)
contour = Contour(Shape=simplify(srf_3), Point=pt_4, Direction=pl, Distance=docunits_4)
debrep_3 = DeconstructBrep(Brep=srf_3)  # -> Faces, Edges, Vertices
join_4 = JoinCurves(Curves=debrep_3.Edges, Preserve=False)  # -> flatten(Curves)
trim = TrimWithRegions(Curve=simplify(contour), Regions=simplify(join_4))  # -> simplify(graft(Inside)), Outside
path_mapper = PathMapper(trim.Inside, source="{A;B;C;D}", target="{A}")
path_mapper_2 = PathMapper(trim.Inside, source="{A;B;C}", target="{A}")
path_mapper_3 = PathMapper(trim.Inside, source="{A;B}", target="{A}")

path_mapper_4 = PathMapper(trim.Inside, source="{A}", target="{0}")
path_mapper_5 = PathMapper(trim.Inside, source="{A}", target="{A}")

crv_3 = Curve(path_mapper_4)
clean_3 = CleanTree(RemoveNulls=True, RemoveInvalid=True, RemoveEmpty=True, Tree=crv_3)
crv_4 = Curve(clean_3)

# ----
# Remapping Values
mesh = MeshBrep(
    Brep=item_2,
    Settings={GridMaxCount=0, GridMinCount=16, JaggedSeams=True, MaxEdgeLength=2000, MinEdgeLength=700, MinTolerance=0, Refine=True, RefineAngle=0, RelativeTolerance=0.65, SimplePlanes=False, Tolerance=0})  # -> simplify(Mesh)
demesh = DeconstructMesh(Mesh=mesh)  # -> Vertices, Faces, Colours, Normals

project_2 = Project(Geometry=demesh.Vertices, Plane=pl)  # -> Geometry, Transform
dist = Distance(PointA=project_2.Geometry, PointB=demesh.Vertices)

mesh_points = Panel(dist)
bnd_4 = Bounds(Numbers=mesh_points)
mesh_points_domain = Panel(bnd_4)

panel_7 = Panel(dist)

remap = RemapNumbers(Value=dist, Source=max_min_result_vector_domain, Target="0 to 100")  # -> Mapped, Clipped
panel_8 = Panel(remap.Clipped)
panel_9 = Panel(remap.Mapped)

remapped_number = Panel(remap.Clipped)
bnd_5 = Bounds(Numbers=remapped_number)
remapped_domain = Panel(bnd_5)

# ----
# Colors sorted for legend
sort = SortList(Keys=remap.Clipped, ValuesA=remap.Clipped)  # -> Keys, ValuesA
panel_10 = Panel(sort.ValuesA)
gradient = Gradient(
    LowerLimit="0",
    UpperLimit="100",
    Parameter=sort.ValuesA,
    stops=[0: RGB(94, 120, 145), 0.38: RGB(167, 209, 82), 0.615: RGB(255, 210, 87), 1: RGB(255, 250, 204)])
gradient_2 = Gradient(
    LowerLimit="0",
    UpperLimit="100",
    Parameter=sort.ValuesA,
    stops=[0: RGB(0, 255, 255), 0.461: RGB(255, 255, 0), 1: RGB(255, 0, 0)])

bnd_6 = Bounds(Numbers=results_2)
dedomain = DeconstructDomain(Domain=bnd_6)  # -> Start, End
smaller = SmallerThan(FirstNumber=dedomain.End, SecondNumber="25")  # -> SmallerThan, OrEqualTo
xor_3 = GateXor(A=Toggle(False), B=smaller.OrEqualTo)
cull_8 = CullPattern(List=gradient_2, CullPattern=invert(xor_3))
cull_9 = CullPattern(List=gradient, CullPattern=xor_3)
data_2 = Data([cull_8, cull_9])

# ----
# IsoCurve and Gradient mesh
panel_11 = Panel("0")
gradient_3 = Gradient(
    LowerLimit=panel_11,
    UpperLimit="100",
    Parameter=remap.Clipped,
    stops=[0: RGB(94, 120, 145), 0.38: RGB(167, 209, 82), 0.615: RGB(255, 210, 87), 1: RGB(255, 250, 204)])
gradient_4 = Gradient(
    LowerLimit=panel_11,
    UpperLimit="100",
    Parameter=remap.Clipped,
    stops=[0: RGB(0, 255, 255), 0.461: RGB(255, 255, 0), 1: RGB(255, 0, 0)])

bnd_7 = Bounds(Numbers=results_2)
dedomain_2 = DeconstructDomain(Domain=bnd_7)  # -> Start, End
smaller_2 = SmallerThan(FirstNumber=dedomain_2.End, SecondNumber="25")  # -> SmallerThan, OrEqualTo
xor_4 = GateXor(A=Toggle(False), B=smaller_2.OrEqualTo)
cull_10 = CullPattern(List=gradient_4, CullPattern=invert(xor_4))
cull_11 = CullPattern(List=gradient_3, CullPattern=xor_4)
data_3 = Data([cull_10, cull_11])
conmesh = ConstructMesh(Vertices=demesh.Vertices, Faces=demesh.Faces, Colours=data_3)  # -> simplify(Mesh)

remapped_numbers = Number(remap.Clipped)
vertices = Point(demesh.Vertices)
crv_5 = Curve(crv_4)
face = MeshFace(demesh.Faces)
pln = Plane(pl)
colors = Data(data_2)
mesh_2 = Mesh(conmesh)
remapped_numbers_2 = ClusterOutput(remapped_numbers)
pln_2 = ClusterOutput(pln)
colors_2 = ClusterOutput(colors)
mesh_3 = ClusterOutput(mesh_2)
crv_6 = ClusterOutput(crv_5)
face_2 = ClusterOutput(face)
vertices_2 = ClusterOutput(vertices)

# ==== cluster SimpleLargestBrep
breps = ClusterInput()

# ---- group: Sort vertical from horizontal faces
breps_2 = Brep(breps)
debrep = DeconstructBrep(Brep=breps_2)  # -> Faces, Edges, Vertices
control_difference_between_incline_of_ho = Slider(0.1, range=0..0.1)  # "control difference between incline of horizontal and vertical faces"
evalsrf = EvaluateSurface(Surface=reparameterize(debrep.Faces), Point="{0.5,0.5,0}")  # -> Point, Normal, UDirection, VDirection, Frame
devec = DeconstructVector(Vector=evalsrf.Normal)  # -> XComponent, YComponent, ZComponent
sqr = Square(Value=devec.ZComponent)
sqrt = SquareRoot(Value=sqr)
larger = LargerThan(FirstNumber=control_difference_between_incline_of_ho, SecondNumber=sqrt)  # -> LargerThan, OrEqualTo
cull = CullPattern(List=debrep.Faces, CullPattern=larger.LargerThan)
area = Area(Geometry=cull)  # -> Area, Centroid
sort = SortList(Keys=area.Area, ValuesA=cull)  # -> Keys, reverse(ValuesA)

# ----
boxprop = BoxProperties(Box=breps_2)  # -> Center, Diagonal, Area, Volume, Degeneracy
amp = Amplitude(Vector=boxprop.Diagonal, Amplitude=Slider(1000, range=0..1000))
vdisex = VectorDisplayEx(Point=boxprop.Center, Vector=amp, Colour=RGB(0, 0, 0), Width=2)

panel = Panel(sqrt)
i = ClusterInput()

# ---- group: Get one of (mostly) two equally sized faces in window geometry (brep)
largestface = Panel("""0
1""")
item = ListItem(List=sort.ValuesA, Index=largestface, Wrap=True)
evalsrf_2 = EvaluateSurface(Surface=reparameterize(item), Point="{0.5,0.5,0}")  # -> Point, Normal, UDirection, VDirection, Frame
item_2 = ListItem(List=flatten(evalsrf_2.Normal), Index=i, Wrap=True)
dprod = DotProduct(VectorA=evalsrf_2.Normal, VectorB=item_2, Unitize=False)
dprod_2 = DotProduct(VectorA=item_2, VectorB=item_2, Unitize=False)
round = Round(Number=dprod)  # -> Nearest, Floor, Ceiling
round_2 = Round(Number=dprod_2)  # -> Nearest, Floor, Ceiling
equals = Equality(FirstNumber=round_2.Nearest, SecondNumber=round.Nearest)  # -> Equality, Inequality
cull_2 = CullPattern(List=item, CullPattern=equals.Equality)

# ----
amp_2 = Amplitude(Vector=evalsrf_2.Normal, Amplitude=Slider(1000, range=0..1000))
vdisex_2 = VectorDisplayEx(Point=evalsrf_2.Point, Vector=amp_2, Colour=RGB(0, 0, 0), Width=2)

panel_2 = Panel(round.Nearest)
panel_3 = Panel(dprod)
L = ClusterOutput(cull_2)

# ==== cluster SimpleSort

# ---- group: Brep
zone = ClusterInput()

# ----
zone_2 = Data(zone)
debrep = DeconstructBrep(Brep=zone_2)  # -> simplify(Faces), Edges, Vertices
evalsrf = EvaluateSurface(Surface=reparameterize(debrep.Faces), Point="{0.5,0.5,0}")  # -> Point, Normal, UDirection, VDirection, Frame
devec = DeconstructVector(Vector=evalsrf.Normal)  # -> XComponent, YComponent, ZComponent
pdecon = Deconstruct(Point=evalsrf.Point)  # -> XComponent, YComponent, ZComponent
sqr = Square(Value=devec.ZComponent)
sqrt = SquareRoot(Value=sqr)
sort = SortList(Keys=pdecon.ZComponent, ValuesA=debrep.Faces)  # -> Keys, ValuesA
larger = LargerThan(FirstNumber=Slider(0.1, range=0..0.1), SecondNumber=sqrt)  # -> LargerThan, OrEqualTo
item = ListItem(List=sort.ValuesA, Index=0, Wrap=True)  # -> Item1, Item
panel = Panel(sqrt)
ceiling = Data(item.Item)
floor = Data(item.Item1)
cull = CullPattern(List=debrep.Faces, CullPattern=larger.LargerThan)

# ---- group: Item -1
ceiling_2 = ClusterOutput(ceiling)

# ---- group: Item
floor_2 = ClusterOutput(floor)

# ----
walls = Data(cull)

# ---- group: List
walls_2 = ClusterOutput(walls)

# ==== cluster CreatesSimLayers

# ----
# Controls
number_slider = Slider(1, range=0..2)
bool = ClusterInput()
bool_2 = Boolean(invert(bool))
xor = GateXor(A=Toggle(False), B=bool_2)
wiredisplay = ControlWireDisplay(WireDisplay=number_slider)

# ----
# Delete Initial Layers
toggle = BooleanToggle(True)
series = Series(Start=1, Step=1, Count=6)
concat = Concatenate(FragmentA="Layer 0", FragmentB=series)
cull = CullPattern(List=concat, CullPattern=xor)
layers = CreateModifyLayers(LayerName=cull, DeleteLayer=toggle, enableFullPath=True)  # -> LayerNames, LayerFullPath

# ----
# Clipping plane layer
panel = Panel("0_ClippingPlanes")  # disabled
swatch = ColourSwatch(SwatchColor=RGB(0, 0, 0))  # disabled
panel_2 = Panel("10000mm")  # disabled
boolean = Boolean(xor)  # disabled
docunits = ConvertToDocumentUnits(ValueString=panel_2)  # disabled
cull_2 = CullPattern(List=panel, CullPattern=xor)  # disabled
layers_2 = CreateModifyLayers(LayerName=cull_2, LayerColor=swatch, DeleteLayer=False, enableFullPath=True)  # -> LayerNames, LayerFullPath; disabled
python = GhPythonScript(x=docunits, y=docunits, bool=boolean, z=layers_2.LayerNames)  # -> out, i, j, k; disabled
# ---------- python: Python ----------
__author__ = "ibc"
__version__ = "2020.10.07"

import rhinoscriptsyntax as rs

import rhinoscriptsyntax as rs
import scriptcontext as sc
import Rhino

name=z
if bool==True:
    sc.doc = Rhino.RhinoDoc.ActiveDoc
    layertable = sc.doc.Layers
    layerindex = layertable.Find(str(name),True)
    i=rs.AddClippingPlane(rs.WorldXYPlane(),x,y)
    j=rs.AddClippingPlane(rs.WorldYZPlane(),x,y)
    k=rs.AddClippingPlane(rs.WorldZXPlane(),x,y)


#print(sc.doc)
# ---------- end python ----------
createatts = CreateAttributes(Name=panel, LayerName=layers_2.LayerFullPath, enableFullPath=True)  # disabled
geo = Geometry([python.i, python.j, python.k])  # disabled
bake_geometry = BakeGeometry(Bake=xor, Geometry=geo, Attributes=createatts, DeleteOldBakes=False, PreserveTrees=False)  # disabled

layer_table = LayerTable(Update=True, AutoUpdate=Toggle(True))  # -> Layers, FullLayerPaths, LayerColors, Linetypes, MaterialNames, Visible, PrintWidth, PrintColor
full_layer_paths = ClusterOutput(layer_table.FullLayerPaths)
panel_3 = Panel(layer_table.FullLayerPaths)

# ----
# Create Layer Data
br18_standard = Panel("""glas_0.72
sensor
terrain_0.10
ceiling_0.70
frames_0.70
floor_0.20
context_0.20
wall_0.50
spatial""")
lng = ListLength(List=br18_standard)
wheel = ColourWheel(
    lng,
    ColourGrips_Style=41,
    ColourGrips_Grip=[5.200421999, 2.058829345, 0.4880330182, 3.629625672],
    ColourGrips_Lum=[0.1, 1],
    ColourGrips_Range=[0.3510875076, 0.3510875076, 0.3510875076, 0.3510875076],
    ColourGrips_Sat=[0.2, 1])
panel_4 = Panel(wheel)
data = Data(graft(panel_4))

# ----
# Make layer white for render view
panel_5 = Panel("""*floor*
*wall*""")
tmatch = MatchText(Text=br18_standard, Pattern=graft(panel_5), Case=True)
lng_2 = ListLength(List=flatten(tmatch))
lng_3 = ListLength(List=panel_5)
division = Division(A=lng_2, B=lng_3)
split = SplitList(List=flatten(tmatch), Index=division)  # -> ListA, ListB
panel_6 = Panel(tmatch)
addition = Addition(A=split.ListA, B=split.ListB)  # -> graft(Result)
panel_7 = Panel(split.ListA)
panel_8 = Panel(split.ListB)

cull_3 = CullPattern(List=simplify(graft(data)), CullPattern=invert(addition))
cull_4 = CullPattern(List=simplify(ColourSwatch(SwatchColor=RGB(255, 255, 255))), CullPattern=addition)
data_2 = Data([cull_3, cull_4])
concat_2 = Concatenate(FragmentA=br18_standard, FragmentC="/", FragmentB=flatten(data_2))
panel_9 = Panel(concat_2)

# ----
# Separate Text
panel_10 = Panel("/")
panel_11 = Panel(data_2)
split_2 = TextSplit(Text=panel_9, Separators=panel_10)  # -> simplify(Result)
panel_12 = Panel(split_2)
item = ListItem(List=panel_12, Index=0, Wrap=True)  # -> Item, Item1
panel_13 = Panel(item.Item)
panel_14 = Panel(item.Item1)
split_3 = TextSplit(Text=panel_13, Separators="_")  # -> simplify(Result)
name = Text(panel_13)
item_2 = ListItem(List=split_3, Index=0, Wrap=True)  # -> Item, Item1, Item2

panel_15 = Panel(item_2.Item1)

# ----
# Naming layers
cull_5 = CullPattern(List=name, CullPattern=xor)
eval = Evaluate(F="Format(\"0_materials::{0}\", x)", x=cull_5)

panel_16 = Panel(eval)

# ----
# Create Colors
panel_17 = Panel(panel_14)
falsestart = Ladybug_FalseStartToggle(False)
tmatch_2 = MatchText(Text=item_2.Item2, Pattern="*glas*", Case=falsestart)
panel_18 = Panel(tmatch_2)
cull_6 = CullPattern(List=panel_17, CullPattern=invert(tmatch_2))
cull_7 = CullPattern(List=ColourSwatch(SwatchColor=RGB(62, 222, 255)), CullPattern=tmatch_2)
col = Colour([cull_7, cull_6])

# ---- group: Materials
panel_19 = Panel("""1
0.60""")
ahsv = SplitAHSV(Colour=col)  # -> Alpha, Hue, Saturation, Value
item_3 = ListItem(List=panel_19, Index=tmatch_2, Wrap=True)
pcent = Percentage(Number=ahsv.Saturation, Percent="40")
colour_hsv = ColourHSV(Alpha=item_3, Hue=ahsv.Hue, Saturation=pcent, Value=ahsv.Value)
panel_20 = Panel(colour_hsv)

# ----
panel_21 = Panel(pcent)

# ----
# Baking Layers
cull_8 = CullPattern(List=col, CullPattern=xor)
cull_9 = CullPattern(List=eval, CullPattern=xor)
layer = DefineLayer(Name=cull_9, Color=cull_8, Material=colour_hsv)
panel_23 = Panel(cull_9)
bakelayer = BakeModifyLayer(Layer=layer, Bake=xor)
panel_24 = Panel(layer)

# ==== cluster Cluster_5
A = ClusterInput()
B = ClusterInput()
division = Division(A=A, B=B)
multiplication = Multiplication(A=division, B=Slider(100, range=0..100))
round = Round(Number=multiplication)  # -> Nearest, Floor, Ceiling
C = ClusterOutput(round.Ceiling)
